# Dynamo graph script.dyn (Dynamo 2.12.1.8246)
# packages: Data-Shapes 2022.2.96, Clockwork for Dynamo 2.x 2.3.0, Crumple 2021.9.24, Orchid 200.4.0.7938, Visual Style Select 1.0.0, Genius Loci 2021.11.10, spring nodes 210.1.1, Clockwork for Dynamo 2.x 2.4.0

directory_path = Directory("C:\RVT_FILES\00_DWG")
directory_from_path = DirectoryObject(path=directory_path)
code_block = CodeBlock { "Exporta Laminas Seleccionadas"; }
code_block_2 = CodeBlock { "INICIAR"; "CANCELAR"; 880; 600; 160; }
code_block_3 = CodeBlock { "CARPETA DE ENTREGA"; }
code_block_4 = CodeBlock { "Seleccion de\nCarpeta"; "BUSCAR"; }
directorypath_data = Custom[DirectoryPath Data](InputName=code_block_4.out0, ButtonText=code_block_4.out1)  # package Data-Shapes; Creates a DirectoryPath input for UI.MultipleInputForm ++ . Check out www.data-shapes.net for more infos!
code_block_5 = CodeBlock { "Nombre de Carpeta"; "CARPETA"; }
textbox_data = Custom[TextBox Data](InputName=code_block_5.out0, DefaultText=code_block_5.out1)  # package Data-Shapes; Create Data for TextBox input in UI.MultipleInputForm ++ . Check out www.data-shapes.net for more informations
list_create = List.Create(item0=directorypath_data, item1=textbox_data)
inputgroup_data = Custom[InputGroup Data](GroupTitle=code_block_3, Inputs=list_create)  # package Data-Shapes; Creates a group of inputs for UI.MultipleInputForm ++ . Check out www.data-shapes.net for more infos !
code_block_6 = CodeBlock { "CARPETA DE DISEÑO"; }
code_block_7 = CodeBlock { "Seleccion de\nCarpeta"; "BUSCAR"; }
directorypath_data_2 = Custom[DirectoryPath Data](InputName=code_block_7.out0, ButtonText=code_block_7.out1)
inputgroup_data_2 = Custom[InputGroup Data](GroupTitle=code_block_6, Inputs=directorypath_data_2)
code_block_8 = CodeBlock { "LAMINAS POR CATEGORIA"; }
code_block_9 = CodeBlock { "Laminas "; }
code_block_10 = CodeBlock { "Sheets"; }
byName = Category.ByName(name=code_block_10)
all_elements_of_category = ElementsOfCategory(Category=byName)
code_block_11 = CodeBlock { "Clasificacion"; }
getParameterValueByName = Element.GetParameterValueByName(element=all_elements_of_category, parameterName=code_block_11)
code_block_12 = CodeBlock { "000"; }
eq = getParameterValueByName == code_block_12
filterByBoolMask = List.FilterByBoolMask(list=all_elements_of_category, mask=eq)
sheetNumber = Sheet.SheetNumber(sheet=filterByBoolMask.out)
sortByKey = List.SortByKey(list=filterByBoolMask.out, keys=sheetNumber)
code_block_13 = CodeBlock { "Clasificacion"; }
getParameterValueByName_2 = Element.GetParameterValueByName(element=sortByKey.sortedList, parameterName=code_block_13)
groupByKey = List.GroupByKey(list=sortByKey.sortedList, keys=getParameterValueByName_2)
add = code_block_9 + groupByKey.uniqueKeys
sheetNumber_2 = Sheet.SheetNumber(sheet=groupByKey.groups@L2)
sheetName = Sheet.SheetName(sheet=groupByKey.groups@L2)
code_block_14 = CodeBlock(sheetNumber=sheetNumber_2, sheetName=sheetName) { "C0-"+sheetNumber+"-"+sheetName; }
code_block_15 = CodeBlock { false; }
listview_data = Custom[Listview Data](InputName=add@L1, Keys=code_block_14@L2, Values=groupByKey.groups@L2, SortItems_optionnal=code_block_15, ShowId_optionnal=code_block_15)  # package Data-Shapes; Create data for ListView input in UI.MultiInputForm ++ . Check out www.data-shapes.net for more infos.
inputgroup_data_3 = Custom[InputGroup Data](GroupTitle=code_block_8, Inputs=listview_data)
list_create_2 = List.Create(item0=inputgroup_data, item1=inputgroup_data_2, item2=inputgroup_data_3)
flatten = List.Flatten(list=list_create_2)
boolean = BoolSelector(true)
multipleinputform = Custom[MultipleInputForm ++](Description_optional=code_block, ButtonText_optional=code_block_2.out0, Inputs=flatten, Toggle=boolean, CancelButtonText_optional=code_block_2.out1, MaxHeight_optional=code_block_2.out2, Width_optional=code_block_2.out3, LabelWidth_optional=code_block_2.out4)  # package Data-Shapes; Create a form with multiple inputs. see www.data-shapes.net for tutorials and infos!
empty = List.Empty()
scopeIf = Custom[ScopeIf+](test=multipleinputform.Was_Cancelled, True=empty, False=multipleinputform.User_Inputs)  # package Clockwork for Dynamo 2.x; A (hopefully) more robust implementation of ScopeIf. Tests a single boolean and returns a value accordingly.
code_block_16 = CodeBlock { 3; }
listsplitatindex = Custom[© ListSplitAtIndex](list=scopeIf, amount=code_block_16)  # package Crumple; Splits a list at a specific index, then returns the two lists. You may need to use levels in order for this to work properly.
identity = Object.Identity(object=listsplitatindex.list1)
codeblock = CodeBlock(value=identity) { value[0]; value[1]; value[2]; }
now = DateTime.Now()
code_block_17 = CodeBlock { "yyyy.MM.dd"; }
format = DateTime.Format(dateTime=now, format=code_block_17)
toUpper = String.ToUpper(string=codeblock.out1)
code_block_18 = CodeBlock(fecha=format, dir=toUpper) { "\\"+fecha+"_"+dir; }
add_2 = codeblock.out0 + code_block_18
directory_from_path_2 = DirectoryObject(path=add_2)
string_from_object = FromObject(obj=directory_from_path_2)
directory_path_2 = Directory("C:\RVT_FILES\00_DWG")
directory_path_3 = Directory("C:\RVT_FILES\00_DWG")
directory_path_4 = Directory("C:\RVT_FILES\00_DWG")
flatten_2 = List.Flatten(list=listsplitatindex.list2)
printer = Printer("PDFCreator")
boolean_2 = BoolSelector(true)
code_block_19 = CodeBlock(x=multipleinputform.User_Inputs)
# ---------- code_block_19.designscript (12 lines) ----------
x;
[Imperative]
{
	if(x == null)
	{
		return = [[],[],[],[],[],[]];
	}
	else
	{
		return = x;
	}
};
# ----------------------------------------
code_block_20 = CodeBlock { 3; }
ꟿ_list_split = Custom[ꟿ List.Split](list=code_block_19.out1, amount=code_block_20)  # package spring nodes; Splits a list at the desired length
flatten_3 = List.Flatten(list=ꟿ_list_split.list2)
code_block_21 = CodeBlock { null; }
replaceEmptyLists = Custom[List.ReplaceEmptyLists](seq=flatten_3, Replacement=code_block_21)  # package Clockwork for Dynamo 2.x; Replaces all empty lists within a given list with a substitute
code_block_22 = CodeBlock(x=replaceEmptyLists)
# ---------- code_block_22.designscript (12 lines) ----------
x;
[Imperative]
{
	if(x == null)
	{
		return = [[],[]];
	}
	else
	{
		return = [x,"PDF001"];
	}
};
# ----------------------------------------
code_block_23 = CodeBlock(x=code_block_22.out1) { x[0]; x[1]; }
create = Orchid.RevitProject.Views.SheetSet.Create(view=code_block_23.out0, name=code_block_23.out1)
print_setting = Setting("PDFCreator_A0")
byViewSheetSet = Orchid.Common.Print.ByViewSheetSet(printer=printer, file=boolean_2, viewSheetSet=create, printSetting=print_setting)
waitfor = Custom[© WaitFor](data=flatten_2, waitFor=byViewSheetSet)  # package Crumple; Tells the first input to wait for the second input to arrive, then passes on the first input. Really useful for scripts which have branching paths that rely on their outputs to carry each other forward. Quite a few custom packages have a 'passthrough' or 'waitfor' node. I use these all the time, so find it useful to have them contained in this package also.
sheetNumber_3 = Sheet.SheetNumber(sheet=waitfor)
code_block_24 = CodeBlock { ["VH","CH","MA"]; }
contains = String.Contains(string=sheetNumber_3@L1, searchFor=code_block_24)
anyTrue = Orchid.Common.List.AnyTrue(list=contains@L2)
filterByBoolMask_2 = List.FilterByBoolMask(list=waitfor, mask=anyTrue)
views = Sheet.Views(sheet=filterByBoolMask_2.in)
code_block_25 = CodeBlock { 1; }
visual_style_select = Custom[Visual Style Select](ViewList=views@L2, Integer=code_block_25)  # package Visual Style Select; Change the Visual Style on a list of views. Please use the following as the integer input: 1 - Wireframe 2 - Hidden line 3 - Shaded 4 - Shaded with Edges 5 - Consistent Colors 6 - Realistic
waitfor_2 = Custom[© WaitFor](data=waitfor, waitFor=visual_style_select)
code_block_26 = CodeBlock { "Clasificacion"; }
getParameterValueByName_3 = Element.GetParameterValueByName(element=waitfor_2, parameterName=code_block_26)
groupByKey_2 = List.GroupByKey(list=waitfor_2, keys=getParameterValueByName_3)
sheetNumber_4 = Sheet.SheetNumber(sheet=groupByKey_2.groups@L2)
sheetName_2 = Sheet.SheetName(sheet=groupByKey_2.groups@L2)
code_block_27 = CodeBlock(sheetNumber=sheetNumber_4, sheetName=sheetName_2) { "C0-"+sheetNumber+"-"+sheetName; }
ᶜᵒⁿᵛᵉʳᵗᵉᵈ_ᶠʳᵒᵐ_ᴰʳᵒᵖᵈᵒʷⁿ_ʷᶦᵗʰ = CodeBlock { DSCore.Types.FindTypeByNameInAssembly("ExportDWGSettings", "RevitAPI"); }  # "ᶜᵒⁿᵛᵉʳᵗᵉᵈ ᶠʳᵒᵐ ᴰʳᵒᵖᵈᵒʷⁿ ʷᶦᵗʰ ᴹᵒⁿᵒᶜˡᵉ™"
all_elements_of_type = ElementsOfType(element_type=ᶜᵒⁿᵛᵉʳᵗᵉᵈ_ᶠʳᵒᵐ_ᴰʳᵒᵖᵈᵒʷⁿ_ʷᶦᵗʰ)
name = Element.Name(element=all_elements_of_type)
code_block_28 = CodeBlock { "SHEET_"; }
contains_2 = String.Contains(string=name, searchFor=code_block_28)
filterByBoolMask_3 = List.FilterByBoolMask(list=name, mask=contains_2)
code_block_29 = CodeBlock { "_"; }
split = String.Split(string=filterByBoolMask_3.in, separator0=code_block_29)
code_block_30 = CodeBlock { 1; }
getItemAtIndex = List.GetItemAtIndex(list=split@L2, index=code_block_30)
byKeysValues = DesignScript.Builtin.Dictionary.ByKeysValues(keys=getItemAtIndex, values=filterByBoolMask_3.in)
code_block_31 = CodeBlock { "Clasificacion"; }
getParameterValueByName_4 = Element.GetParameterValueByName(element=groupByKey_2.groups@L2, parameterName=code_block_31)
valueAtKey = DesignScript.Builtin.Dictionary.ValueAtKey(dictionary=byKeysValues, key=getParameterValueByName_4@L2)
uniqueItems = List.UniqueItems(list=valueAtKey@L2)
boolean_3 = BoolSelector(true)
export_dwg_in_document = Custom[Export DWG in Document](DirectoryPath=directory_path_4, view=groupByKey_2.groups@L2, Filename=code_block_27@L2, ExportSetup=uniqueItems@L2, RunIt=boolean_3)  # package Genius Loci; Export views to DWG with export setup in the active or given document. Based on a script by Konrad K Sobon.
waitfor_3 = Custom[© WaitFor](data=directory_path_3, waitFor=export_dwg_in_document)
code_block_32 = CodeBlock { 10; }
delay = Custom[© Delay](data=waitfor_3, seconds=code_block_32, limit=code_block_32)  # package Crumple; Given a duration in seconds and some data, this script will delay that data by the given time. A threshold of 3 seconds is used by default to stop an undesirable number being provided.
code_block_33 = CodeBlock { "*.pcp"; }
contents = Orchid.Common.Directory.Contents(directory=delay.data, searchString=code_block_33)
deleteFile = FileSystem.DeleteFile(path=contents)
waitfor_4 = Custom[© WaitFor](data=directory_path_2, waitFor=deleteFile)
code_block_34 = CodeBlock { "*.dwg"; }
contents_2 = Orchid.Common.Directory.Contents(directory=waitfor_4, searchString=code_block_34)
code_block_35 = CodeBlock { "-"; }
split_2 = String.Split(string=contents_2, separator0=code_block_35)
code_block_36 = CodeBlock { 1; }
getItemAtIndex_2 = List.GetItemAtIndex(list=split_2@L2, index=code_block_36)
groupByKey_3 = List.GroupByKey(list=contents_2, keys=getItemAtIndex_2)
directory_path_5 = Directory("C:\RVT_FILES\00_DWG")
code_block_37 = CodeBlock()
# ---------- code_block_37.designscript (26 lines) ----------
[
"CF - Cielos Falsos",
"CH - Armadura Columnas",
"CI - Cines",
"DE - Detalle Estanques",
"EM - Estructura Metalica",
"ES - Escaleras",
"LO - Armadura Losas",
"MA - Muros Hormigon Armado",
"MC - Montacargas",
"OE - Obras Exteriores",
"PC - Planos de Carga",
"PE - PLano Extendido",
"PG - Planos Generales",
"RP - Rampas",
"SK - Esquemas",
"ST - Planos Standar",
"TA - Talud",
"TH - Tipo de Hormigon",
"VA - Varios",
"VH - Armadura Vigas",
"DM - Demolicion",
"FPL - Pilas",
"RF - Refuerzo",
"EL - Elevacion"
];
# ----------------------------------------
code_block_38 = CodeBlock { " - "; }
split_3 = String.Split(string=code_block_37, separator0=code_block_38)
code_block_39 = CodeBlock { 0; }
getItemAtIndex_3 = List.GetItemAtIndex(list=split_3@L2, index=code_block_39)
byKeysValues_2 = DesignScript.Builtin.Dictionary.ByKeysValues(keys=getItemAtIndex_3, values=code_block_37)
code_block_40 = CodeBlock { "\\"; }
split_4 = String.Split(string=contents_2, separator0=code_block_40)
code_block_41 = CodeBlock { 3; }
getItemAtIndex_4 = List.GetItemAtIndex(list=split_4@L2, index=code_block_41)
code_block_42 = CodeBlock { "-"; }
split_5 = String.Split(string=getItemAtIndex_4, separator0=code_block_42)
code_block_43 = CodeBlock { 1; }
getItemAtIndex_5 = List.GetItemAtIndex(list=split_5@L2, index=code_block_43)
valueAtKey_2 = DesignScript.Builtin.Dictionary.ValueAtKey(dictionary=byKeysValues_2, key=getItemAtIndex_5)
code_block_44 = CodeBlock(dir=directory_path_5, cat=valueAtKey_2, files=getItemAtIndex_4) { dir+"\\"+cat+"\\00_DWG\\"+files; }
directory_path_6 = Directory("C:\RVT_FILES\00_DWG")
code_block_45 = CodeBlock(dir=directory_path_6, cat=valueAtKey_2) { dir+"\\"+cat+"\\00_DWG"; }
directory_from_path_3 = DirectoryObject(path=code_block_45)
waitfor_5 = Custom[© WaitFor](data=code_block_44, waitFor=directory_from_path_3)
code_block_46 = CodeBlock { "-"; }
split_6 = String.Split(string=waitfor_5, separator0=code_block_46)
code_block_47 = CodeBlock { 1; }
getItemAtIndex_6 = List.GetItemAtIndex(list=split_6@L2, index=code_block_47)
groupByKey_4 = List.GroupByKey(list=waitfor_5, keys=getItemAtIndex_6)
code_block_48 = CodeBlock { true; }
moveFile = FileSystem.MoveFile(path=groupByKey_3.groups@L2, newPath=groupByKey_4.groups@L2, overwrite=code_block_48, lacing=Longest)
waitfor_6 = Custom[© WaitFor](data=string_from_object, waitFor=moveFile)
directory_path_7 = Directory("C:\RVT_FILES\00_DWG")
directory_from_path_4 = DirectoryObject(path=directory_path_7)
code_block_49 = CodeBlock { true; }
copyDirectory = FileSystem.CopyDirectory(directory=directory_from_path_4, destinationPath=waitfor_6, overwriteFiles=code_block_49)
waitfor_7 = Custom[© WaitFor](data=waitfor_6, waitFor=copyDirectory)
directory_from_path_5 = DirectoryObject(path=waitfor_7)
directory_from_path_6 = DirectoryObject(path=codeblock.out2)
string_from_object_2 = FromObject(obj=directory_from_path_6)
code_block_50 = CodeBlock { true; }
copyDirectory_2 = FileSystem.CopyDirectory(directory=directory_from_path_5, destinationPath=string_from_object_2, overwriteFiles=code_block_50)
waitfor_8 = Custom[© WaitFor](data=directory_from_path, waitFor=copyDirectory_2)
getDirectoryContents = FileSystem.GetDirectoryContents(directory=waitfor_8)
code_block_51 = CodeBlock { true; }
deleteDirectory = FileSystem.DeleteDirectory(path=getDirectoryContents.directories, recursive=code_block_51)
deleteFile_2 = FileSystem.DeleteFile(path=getDirectoryContents.files)
identity_2 = Object.Identity(object=waitfor_2)
waitfor_9 = Custom[© WaitFor](data=identity_2, waitFor=export_dwg_in_document)
sheetNumber_5 = Sheet.SheetNumber(sheet=waitfor_9)
code_block_52 = CodeBlock { ["VH","CH","MA"]; }
contains_3 = String.Contains(string=sheetNumber_5@L1, searchFor=code_block_52)
anyTrue_2 = Orchid.Common.List.AnyTrue(list=contains_3@L2)
filterByBoolMask_4 = List.FilterByBoolMask(list=waitfor_9, mask=anyTrue_2)
views_2 = Sheet.Views(sheet=filterByBoolMask_4.in)
code_block_53 = CodeBlock { 7; }
visual_style_select_2 = Custom[Visual Style Select](ViewList=views_2@L2, Integer=code_block_53)
code_block_54 = CodeBlock { "*.pdf"; }
directory_path_8 = Directory("C:\RVT_FILES\01_PDF")
directory_from_path_7 = DirectoryObject(path=directory_path_8)
directory_path_9 = Directory("C:\RVT_FILES\01_PDF")
directory_path_10 = Directory("C:\RVT_FILES\01_PDF")
end = Revit.Transaction.Transaction.End(input=byViewSheetSet)
waitfor_10 = Custom[© WaitFor](data=directory_path_10, waitFor=end)
code_block_55 = CodeBlock { 15; }
delay_2 = Custom[© Delay](data=waitfor_10, seconds=code_block_55, limit=code_block_55)
string = StringInput("")
contents_3 = Orchid.Common.Directory.Contents(directory=delay_2.data)
fileName = FileSystem.FileName(path=contents_3)
code_block_56 = CodeBlock { "-"; }
code_block_57 = CodeBlock { " - "; }
split_7 = String.Split(string=contents_3, separator0=code_block_57)
code_block_58 = CodeBlock { null; }
replaceEmptyLists_2 = Custom[List.ReplaceEmptyLists](seq=split_7, Replacement=code_block_58)
code_block_59 = CodeBlock(x=replaceEmptyLists_2)
# ---------- code_block_59.designscript (12 lines) ----------
x;
[Imperative]
{
	if(x == null)
	{
		return = [null,null,null,null];
	}
	else
	{
		return = x;
	}
};
# ----------------------------------------
code_block_60 = CodeBlock { [2,3]; }
getItemAtIndex_7 = List.GetItemAtIndex(list=code_block_59.out1@L2, index=code_block_60)
code_block_61 = CodeBlock { "C0"; }
addItemToEnd = List.AddItemToEnd(item=getItemAtIndex_7@L2, list=code_block_61)
flatten_4 = List.Flatten(list=addItemToEnd@L3)
join = String.Join(separator=code_block_56@L2, string0=flatten_4)
flatten_5 = List.Flatten(list=join)
rename = Orchid.Common.File.Rename(directory=delay_2.data, extension=string, sourceName=fileName, targetName=flatten_5)
waitfor_11 = Custom[© WaitFor](data=directory_path_9, waitFor=rename)
directory_from_path_8 = DirectoryObject(path=waitfor_11)
getDirectoryContents_2 = FileSystem.GetDirectoryContents(directory=directory_from_path_8)
code_block_62 = CodeBlock { "-"; }
split_8 = String.Split(string=getDirectoryContents_2.files, separator0=code_block_62)
code_block_63 = CodeBlock { null; }
replaceEmptyLists_3 = Custom[List.ReplaceEmptyLists](seq=split_8, Replacement=code_block_63)
code_block_64 = CodeBlock(x=replaceEmptyLists_3)  # same code as code_block_59
code_block_65 = CodeBlock { 1; }
getItemAtIndex_8 = List.GetItemAtIndex(list=code_block_64.out1@L2, index=code_block_65)
list_clean = Custom[List Clean](list=getItemAtIndex_8)  # package Genius Loci; Removes all Null, Empty and Blank from a list or nested list of lists.
groupByKey_5 = List.GroupByKey(list=getDirectoryContents_2.files, keys=list_clean)
directory_path_11 = Directory("C:\RVT_FILES\01_PDF")
code_block_66 = CodeBlock()  # same code as code_block_37
code_block_67 = CodeBlock { " - "; }
split_9 = String.Split(string=code_block_66, separator0=code_block_67)
code_block_68 = CodeBlock { 0; }
getItemAtIndex_9 = List.GetItemAtIndex(list=split_9@L2, index=code_block_68)
byKeysValues_3 = DesignScript.Builtin.Dictionary.ByKeysValues(keys=getItemAtIndex_9, values=code_block_66)
code_block_69 = CodeBlock { "\\"; }
split_10 = String.Split(string=getDirectoryContents_2.files, separator0=code_block_69)
code_block_70 = CodeBlock { null; }
replaceEmptyLists_4 = Custom[List.ReplaceEmptyLists](seq=split_10, Replacement=code_block_70)
code_block_71 = CodeBlock(x=replaceEmptyLists_4)  # same code as code_block_59
code_block_72 = CodeBlock { 3; }
getItemAtIndex_10 = List.GetItemAtIndex(list=code_block_71.out1@L2, index=code_block_72)
list_clean_2 = Custom[List Clean](list=getItemAtIndex_10)
code_block_73 = CodeBlock { "-"; }
split_11 = String.Split(string=list_clean_2, separator0=code_block_73)
code_block_74 = CodeBlock { null; }
replaceEmptyLists_5 = Custom[List.ReplaceEmptyLists](seq=split_11, Replacement=code_block_74)
code_block_75 = CodeBlock(x=replaceEmptyLists_5)  # same code as code_block_59
code_block_76 = CodeBlock { 1; }
getItemAtIndex_11 = List.GetItemAtIndex(list=code_block_75.out1@L2, index=code_block_76)
list_clean_3 = Custom[List Clean](list=getItemAtIndex_11)
valueAtKey_3 = DesignScript.Builtin.Dictionary.ValueAtKey(dictionary=byKeysValues_3, key=list_clean_3)
code_block_77 = CodeBlock(dir=directory_path_11, cat=valueAtKey_3, files=list_clean_2) { dir+"\\"+cat+"\\01_PDF\\"+files; }
directory_path_12 = Directory("C:\RVT_FILES\01_PDF")
code_block_78 = CodeBlock(dir=directory_path_12, cat=valueAtKey_3) { dir+"\\"+cat+"\\01_PDF"; }
directory_from_path_9 = DirectoryObject(path=code_block_78)
waitfor_12 = Custom[© WaitFor](data=code_block_77, waitFor=directory_from_path_9)
code_block_79 = CodeBlock { "-"; }
split_12 = String.Split(string=waitfor_12, separator0=code_block_79)
code_block_80 = CodeBlock { null; }
replaceEmptyLists_6 = Custom[List.ReplaceEmptyLists](seq=split_12, Replacement=code_block_80)
code_block_81 = CodeBlock(x=replaceEmptyLists_6)  # same code as code_block_59
code_block_82 = CodeBlock { 1; }
getItemAtIndex_12 = List.GetItemAtIndex(list=code_block_81.out1@L2, index=code_block_82)
list_clean_4 = Custom[List Clean](list=getItemAtIndex_12)
groupByKey_6 = List.GroupByKey(list=waitfor_12, keys=list_clean_4)
code_block_83 = CodeBlock { true; }
moveFile_2 = FileSystem.MoveFile(path=groupByKey_5.groups@L2, newPath=groupByKey_6.groups@L2, overwrite=code_block_83, lacing=Longest)
waitfor_13 = Custom[© WaitFor](data=string_from_object, waitFor=moveFile_2)
directory_path_13 = Directory("C:\RVT_FILES\01_PDF")
directory_from_path_10 = DirectoryObject(path=directory_path_13)
code_block_84 = CodeBlock { true; }
copyDirectory_3 = FileSystem.CopyDirectory(directory=directory_from_path_10, destinationPath=waitfor_13, overwriteFiles=code_block_84)
waitfor_14 = Custom[© WaitFor](data=waitfor_13, waitFor=copyDirectory_3)
directory_from_path_11 = DirectoryObject(path=waitfor_14)
code_block_85 = CodeBlock { true; }
copyDirectory_4 = FileSystem.CopyDirectory(directory=directory_from_path_11, destinationPath=string_from_object_2, overwriteFiles=code_block_85)
waitfor_15 = Custom[© WaitFor](data=directory_from_path_7, waitFor=copyDirectory_4)
getDirectoryContents_3 = FileSystem.GetDirectoryContents(directory=waitfor_15)
code_block_86 = CodeBlock { true; }
deleteDirectory_2 = FileSystem.DeleteDirectory(path=getDirectoryContents_3.directories, recursive=code_block_86)
deleteFile_3 = FileSystem.DeleteFile(path=getDirectoryContents_3.files)
waitfor_16 = Custom[© WaitFor](data=create, waitFor=end)
delete = Orchid.RevitProject.Views.SheetSet.Delete(viewSheetSet=waitfor_16)
