# Dynamo graph script.dyn (Dynamo 2.12.1.8246)
# packages: spring nodes 210.1.1, Crumple 2022.2.13

getwarnings = Custom[© GetWarnings]()  # package Crumple; Returns all warnings in the Revit model in their Revit db format.
warningmessage = Custom[© WarningMessage](warning=getwarnings)  # package Crumple; Given a warning element in Revit db format, will return the message associated with that warning in a generic string format.
code_block = CodeBlock { "Highlighted elements are joined but"; }
contains = String.Contains(string=warningmessage, searchFor=code_block)
filterByBoolMask = List.FilterByBoolMask(list=getwarnings, mask=contains)
warningelements = Custom[© WarningElements](warning=filterByBoolMask.in)  # package Crumple; Returns the element(s) associated with the provided warning.
transpose = List.Transpose(lists=warningelements)
codeblock = CodeBlock(value=transpose) { value[0]; value[1]; }
ꟿ_element_unjoin = Custom[ꟿ Element.Unjoin](firstElement=codeblock.out0, secondElement=codeblock.out1)  # package spring nodes; Unjoins the element(s) in the second list from the primary input element.
