# Dynamo graph emplantillado_script.dyn (Dynamo 2.12.1.8246)
# packages: Data-Shapes 2022.2.96, Genius Loci 2021.11.10, Clockwork for Dynamo 2.x 2.4.0, spring nodes 210.1.1, Rhythm 2020.7.25

code_block = CodeBlock { "Emplantillado"; }
file_path = Filename("..\..\..\..\..\..\..\..\..\..\Arainco\Arainco.png")
code_block_2 = CodeBlock()
# ---------- code_block_2.designscript (11 lines) ----------
//buttonText
"INICIAR";

//cancelButton
"CANCELAR";

//width
430;

//labelWidth
130;
# ----------------------------------------
code_block_3 = CodeBlock { "Selecciona las Fundaciones"; }
code_block_4 = CodeBlock { "SELECCIONAR"; }
code_block_5 = CodeBlock { "Structural Foundations"; }
byName = Category.ByName(name=code_block_5)
selectmodelelements_data = Custom[SelectModelElements Data](InputName=code_block_3, ButtonText=code_block_4, CategoryFilter=byName)  # package Data-Shapes; Creates a Revit element selection input for UI.MultipleInputForm++ . Check out www.data-shapes.net for more infos!
boolean = BoolSelector(true)
multipleinputform = Custom[MultipleInputForm ++](Description_optional=code_block, Logo_optional=file_path, ButtonText_optional=code_block_2.out0, Inputs=selectmodelelements_data, Toggle=boolean, CancelButtonText_optional=code_block_2.out1, Width_optional=code_block_2.out2, LabelWidth_optional=code_block_2.out3)  # package Data-Shapes; Create a form with multiple inputs. see www.data-shapes.net for tutorials and infos!
code_block_6 = CodeBlock(x=multipleinputform.User_Inputs)
# ---------- code_block_6.designscript (12 lines) ----------
x;
[Imperative]
{
	if(x == null)
	{
		return = [[]];
	}
	else
	{
		return = x;
	}
};
# ----------------------------------------
code_block_7 = CodeBlock(l=code_block_6.out1) { l[0]; }
element_surfaces_references = Custom[Element Surfaces References](element=code_block_7@L1)  # package Genius Loci; Retrieve the top, bottom, side surfaces and their associated references of the system family. This doesn't work with cylindrical system families (pipe...)
flatten = List.Flatten(list=element_surfaces_references.Bottom_Surface)
perimeterCurves = Surface.PerimeterCurves(surface=flatten)
code_block_8 = CodeBlock { null; }
replaceEmptyLists = Custom[List.ReplaceEmptyLists](seq=perimeterCurves, Replacement=code_block_8)  # package Clockwork for Dynamo 2.x; Replaces all empty lists within a given list with a substitute
code_block_9 = CodeBlock { "EMPLANTILLADO e=50"; }
byName_2 = FloorType.ByName(name=code_block_9)
closest_level = Custom[Closest Level](element=code_block_7)  # package Genius Loci; Return the closest level below the given element.
byOutlineTypeAndLevel = Floor.ByOutlineTypeAndLevel(outlineCurves=replaceEmptyLists@L2, floorType=byName_2@L1, level=closest_level@L1, lacing=Longest)
end = Revit.Transaction.Transaction.End(input=byOutlineTypeAndLevel)
ʳʰʸᵗʰᵐ_elements_joinedelements = Rhythm.Revit.Elements.Elements.JoinedElements(element=end)
ꟿ_element_unjoin = Custom[ꟿ Element.Unjoin](firstElement=end@L1, secondElement=ʳʰʸᵗʰᵐ_elements_joinedelements@L2, lacing=Longest)  # package spring nodes; Unjoins the element(s) in the second list from the primary input element.
