# Dynamo graph extensionVerticalEjes_script.dyn (Dynamo 2.12.1.8246)
# packages: Orchid 212.1.0.8161

code_block = CodeBlock { "Grids"; }
byName = Category.ByName(name=code_block)
all_elements_of_category = ElementsOfCategory(Category=byName)
code_block_2 = CodeBlock { "Levels"; }
byName_2 = Category.ByName(name=code_block_2)
all_elements_of_category_2 = ElementsOfCategory(Category=byName_2)
elevation = Level.Elevation(level=all_elements_of_category_2)
maximumItem = List.MaximumItem(list=elevation)
eq = elevation == maximumItem
filterByBoolMask = List.FilterByBoolMask(list=all_elements_of_category_2, mask=eq)
elevation_2 = Level.Elevation(level=filterByBoolMask.in)
code_block_3 = CodeBlock { 3500; }
add = elevation_2 + code_block_3
all_elements_of_category_3 = ElementsOfCategory(Category=byName_2)
elevation_3 = Level.Elevation(level=all_elements_of_category_3)
minimumItem = List.MinimumItem(list=elevation_3)
eq_2 = elevation_3 == minimumItem
filterByBoolMask_2 = List.FilterByBoolMask(list=all_elements_of_category_3, mask=eq_2)
elevation_4 = Level.Elevation(level=filterByBoolMask_2.in)
code_block_4 = CodeBlock { -3500; }
add_2 = elevation_4 + code_block_4
o_grid_setverticalextents = Orchid.RevitProject.Datums.Grid.SetVerticalExtents(grid=all_elements_of_category, topExtent=add, bottomExtent=add_2, lacing=Longest)
