# Dynamo graph cropBoxxByCurves_script.dyn (Dynamo 2.12.1.8246)
# packages: Orchid 200.4.0.7938, archi-lab.net 2022.210.2419, Data-Shapes 2021.2.94

activeView = Orchid.RevitProject.Common.Document.ActiveView()
setCropBoxByCurves = archilab.Revit.Views.Views.SetCropBoxByCurves(view=activeView)  # unwired: curves
byJoinedCurves = PolyCurve.ByJoinedCurves()  # unwired: curves
code_block = CodeBlock { "Crop View por Lineas"; }
file_path = Filename("..\..\..\..\..\..\..\..\..\..\..\Arainco\Arainco.png")
code_block_2 = CodeBlock()
# ---------- code_block_2.designscript (10 lines) ----------
//buttonText
"INICIAR";
//buttonCancel
"CANCELAR";
//maxHeight

//width
440;
//label
180;
# ----------------------------------------
code_block_3 = CodeBlock { "Seleccionar las Lineas"; }
code_block_4 = CodeBlock { "SELECCIONAR"; }
code_block_5 = CodeBlock { "Lines"; }
byName = Category.ByName(name=code_block_5)
selectmodelelements_data = Custom[SelectModelElements Data](InputName=code_block_3, ButtonText=code_block_4, CategoryFilter=byName)  # package Data-Shapes; Creates a Revit element selection input for UI.MultipleInputForm++ . Check out www.data-shapes.net for more infos!
boolean = BoolSelector(true)
multipleinputform = Custom[MultipleInputForm ++](Description_optional=code_block, Logo_optional=file_path, ButtonText_optional=code_block_2.out0, Inputs=selectmodelelements_data, Toggle=boolean, CancelButtonText_optional=code_block_2.out1, Width_optional=code_block_2.out2, LabelWidth_optional=code_block_2.out3)  # package Data-Shapes; Create a form with multiple inputs. see www.data-shapes.net for tutorials and infos!
code_block_6 = CodeBlock(x=multipleinputform.User_Inputs)
# ---------- code_block_6.designscript (13 lines) ----------
x;

[Imperative]
{
	if(x == null)
	{
		return = [[],[]];
	}
	else
	{
		return = x;
	}
};
# ----------------------------------------
code_block_7 = CodeBlock(l=code_block_6.out1) { l[0]; }
geometry = Element.Geometry(element=code_block_7)
flatten = List.Flatten(list=geometry)
function_apply = ApplyFunction(func=byJoinedCurves, arg1=flatten)
code_block_8 = CodeBlock(x=function_apply)
# ---------- code_block_8.designscript (13 lines) ----------
x;

[Imperative]
{
	if(x == null)
	{
		return = [];
	}
	else
	{
		return = x;
	}
};
# ----------------------------------------
explode = Geometry.Explode(geometry=code_block_8.out1)
function_apply_2 = ApplyFunction(func=setCropBoxByCurves, arg1=explode)
code_block_9 = CodeBlock(x=function_apply_2, y=code_block_7)
# ---------- code_block_9.designscript (14 lines) ----------
x;
y;

[Imperative]
{
	if(x == null)
	{
		return = [[],[]];
	}
	else
	{
		return = [x,y];
	}
};
# ----------------------------------------
code_block_10 = CodeBlock(y=code_block_9.out2) { y[1]; }
delete = archilab.Revit.Elements.Elements.Delete(element=code_block_10)
code_block_11 = CodeBlock(x=code_block_9.out2) { x[0]; }
code_block_12 = CodeBlock { ["Crop View","Crop Region Visible"]; [1,0]; }
setParameterByName = Element.SetParameterByName(element=code_block_11@L1, parameterName=code_block_12.out0@L2, value=code_block_12.out1@L2, lacing=Longest)
