# Dynamo graph eliminarEtiquetas_script.dyn (Dynamo 2.12.1.8246)
# packages: Orchid 200.4.0.7938

code_block = CodeBlock()
# ---------- code_block.designscript (7 lines) ----------
[
"Structural Framing Tags",
"Wall Tags",
"Structural Foundation Tags",
"Structural Column Tags",
"Floor Tags"
];
# ----------------------------------------
byName = Category.ByName(name=code_block)
activeView = Orchid.RevitProject.Common.Document.ActiveView()
all_elements_of_category_in_view = ElementsOfCategoryInView(Category=byName, View=activeView)
flatten = List.Flatten(list=all_elements_of_category_in_view)
delete = Element.Delete(element=flatten)
