# Dynamo graph script.dyn (Dynamo 2.12.1.8246)
# packages: Orchid 200.4.0.7938, archi-lab.net 2022.210.2419, Data-Shapes 2021.2.94, spring nodes 210.1.1

activeView = Orchid.RevitProject.Common.Document.ActiveView()
code_block = CodeBlock { "Propagate Extents"; }
file_path = Filename("..\..\..\..\..\..\..\..\..\..\..\Arainco\Arainco.png")
code_block_2 = CodeBlock()
# ---------- code_block_2.designscript (8 lines) ----------
//buttonTexxt
"INICIAR";
//cancelButton
"CANCELAR";
//maxHeight
800;
//width
500;
# ----------------------------------------
code_block_3 = CodeBlock { "Todas las Vistas de Planta"; }
code_block_4 = CodeBlock()
# ---------- code_block_4.designscript (2 lines) ----------
["EngineeringPlan",
"CeilingPlan"];
# ----------------------------------------
getByType = archilab.Revit.Views.Views.GetByType(viewType=code_block_4)
flatten = List.Flatten(list=getByType)
code_block_5 = CodeBlock { "Clasificacion"; }
getParameterValueByName = Element.GetParameterValueByName(element=flatten, parameterName=code_block_5)
activeView_2 = Orchid.RevitProject.Common.Document.ActiveView()
code_block_6 = CodeBlock { "Clasificacion"; }
getParameterValueByName_2 = Element.GetParameterValueByName(element=activeView_2, parameterName=code_block_6)
eq = getParameterValueByName == getParameterValueByName_2
filterByBoolMask = List.FilterByBoolMask(list=flatten, mask=eq)
name = Element.Name(element=activeView_2)
name_2 = Element.Name(element=filterByBoolMask.in)
eq_2 = name == name_2
filterByBoolMask_2 = List.FilterByBoolMask(list=filterByBoolMask.in, mask=eq_2)
code_block_7 = CodeBlock { "Zona"; }
getParameterValueByName_3 = Element.GetParameterValueByName(element=filterByBoolMask_2.out, parameterName=code_block_7)
sortByKey = List.SortByKey(list=filterByBoolMask_2.out, keys=getParameterValueByName_3)
name_3 = Element.Name(element=sortByKey.sortedList)
code_block_8 = CodeBlock()
# ---------- code_block_8.designscript (8 lines) ----------
//hight
480;
//elemCount
true;
//sort
false;
//iD
false;
# ----------------------------------------
listview_data = Custom[Listview Data](Keys=name_3, Values=sortByKey.sortedList, Height_optionnal=code_block_8.out0, ShowElementCount_optionnal=code_block_8.out1, SortItems_optionnal=code_block_8.out2, ShowId_optionnal=code_block_8.out3)  # package Data-Shapes; Create data for ListView input in UI.MultiInputForm ++ . Check out www.data-shapes.net for more infos.
inputgroup_data = Custom[InputGroup Data](GroupTitle=code_block_3, Inputs=listview_data)  # package Data-Shapes; Creates a group of inputs for UI.MultipleInputForm ++ . Check out www.data-shapes.net for more infos !
boolean = BoolSelector(true)
multipleinputform = Custom[MultipleInputForm ++](Description_optional=code_block, Logo_optional=file_path, ButtonText_optional=code_block_2.out0, Inputs=inputgroup_data, Toggle=boolean, CancelButtonText_optional=code_block_2.out1, Width_optional=code_block_2.out3)  # package Data-Shapes; Create a form with multiple inputs. see www.data-shapes.net for tutorials and infos!
code_block_9 = CodeBlock(x=multipleinputform.User_Inputs)
# ---------- code_block_9.designscript (12 lines) ----------
x;
[Imperative]
{
	if(x == null)
		{
		return = [];
		}
	else
		{
		return = DSCore.List.Flatten(x,1);
		}
};
# ----------------------------------------
code_block_10 = CodeBlock { "Dimensions"; }
byName = Category.ByName(name=code_block_10)
activeView_3 = Orchid.RevitProject.Common.Document.ActiveView()
all_elements_of_category_in_view = ElementsOfCategoryInView(Category=byName, View=activeView_3)
ꟿ_document_copyfromviewtoview = Custom[ꟿ Document.CopyFromViewToView](sourceView=activeView, destView=code_block_9.out1@L1, elements=all_elements_of_category_in_view)  # package spring nodes; The node will copy the input (view based) elements from the source view into the destination view.
