# Dynamo graph script.dyn (Dynamo 2.12.1.8246)
# packages: archi-lab.net 2022.210.2419, Orchid 200.4.0.7938, Data-Shapes 2021.2.94

code_block = CodeBlock { "Visibilidad Worksets en View Templates"; }
file_path = Filename("..\..\..\..\..\..\..\..\..\..\Arainco\Arainco.png")
code_block_2 = CodeBlock { "INICIAR"; "CANCELAR"; 950; 500; }
code_block_3 = CodeBlock { "View Templates"; }
all = Orchid.RevitProject.Views.ViewTemplate.All()
name = Element.Name(element=all)
code_block_4 = CodeBlock { false; }
listview_data = Custom[Listview Data](InputName=code_block_3, Keys=name, Values=all, ShowId_optionnal=code_block_4)  # package Data-Shapes; Create data for ListView input in UI.MultiInputForm ++ . Check out www.data-shapes.net for more infos.
code_block_5 = CodeBlock { "Worksets"; }
getAll = archilab.Revit.Elements.Workset.GetAll()
name_2 = archilab.Revit.Elements.Workset.Name(workset=getAll)
code_block_6 = CodeBlock { false; }
listview_data_2 = Custom[Listview Data](InputName=code_block_5, Keys=name_2, Values=getAll, ShowId_optionnal=code_block_6)
code_block_7 = CodeBlock { "Visibilidad"; }
code_block_8 = CodeBlock { ["Visible","Hide"]; 0; }
radiobuttons_data = Custom[RadioButtons Data](InputName=code_block_7, Keys=code_block_8.out0, Values=code_block_8.out0, DefaultValueIndex=code_block_8.out1)  # package Data-Shapes; Create radio buttons input for UI.MultipleInputForm ++ .
list_create = List.Create(item0=listview_data, item1=listview_data_2, item2=radiobuttons_data)
boolean = BoolSelector(true)
multipleinputform = Custom[MultipleInputForm ++](Description_optional=code_block, Logo_optional=file_path, ButtonText_optional=code_block_2.out0, Inputs=list_create, Toggle=boolean, CancelButtonText_optional=code_block_2.out1, MaxHeight_optional=code_block_2.out2, Width_optional=code_block_2.out3)  # package Data-Shapes; Create a form with multiple inputs. see www.data-shapes.net for tutorials and infos!
code_block_9 = CodeBlock(x=multipleinputform.User_Inputs)
# ---------- code_block_9.designscript (12 lines) ----------
x;
[Imperative]
{
	if(x == null)
	{
		return = [[],[],[]];
	}
	else
	{
		return = x;
	}
};
# ----------------------------------------
code_block_10 = CodeBlock(x=code_block_9.out1) { x[0]; }
code_block_11 = CodeBlock(x=code_block_9.out1) { x[1]; }
code_block_12 = CodeBlock(x=code_block_9.out1) { x[2]; }
setWorksetVisibility = archilab.Revit.Views.Views.SetWorksetVisibility(view=code_block_10@L1, worksets=code_block_11@L2, visibility=code_block_12@L1, lacing=Longest)
