# Dynamo graph script.dyn (Dynamo 2.12.1.8246)
# packages: Data-Shapes 2022.2.96, Clockwork for Dynamo 2.x 2.3.0, Orchid 200.4.0.7938, Genius Loci 2021.11.10, Data-Shapes 2021.2.94

code_block = CodeBlock { "Structural Foundations"; }
byName = Category.ByName(name=code_block)
activeView = Orchid.RevitProject.Common.Document.ActiveView()
all_elements_of_category_in_view = ElementsOfCategoryInView(Category=byName, View=activeView)
code_block_2 = CodeBlock { "Numeracion Fundacion"; }
exists = Orchid.RevitProject.Parameters.Parameter.Exists(parameterName=code_block_2, element=all_elements_of_category_in_view)
filterByBoolMask = List.FilterByBoolMask(list=all_elements_of_category_in_view, mask=exists)
code_block_3 = CodeBlock { "Numeracion Fundacion"; }
getParameterValueByName = Element.GetParameterValueByName(element=filterByBoolMask.in, parameterName=code_block_3)
code_block_4 = CodeBlock { "Busca y Selecciona Fundación en Vista"; }
file_path = Filename("..\..\..\..\..\..\..\..\..\..\..\Arainco\Arainco.png")
code_block_5 = CodeBlock { "INICIAR"; "CANCELAR"; 850; 430; }
code_block_6 = CodeBlock { "Selecciona una Fundacion"; }
code_block_7 = CodeBlock { "F"; }
code_block_8 = CodeBlock { "Structural Foundations"; }
byName_2 = Category.ByName(name=code_block_8)
activeView_2 = Orchid.RevitProject.Common.Document.ActiveView()
all_elements_of_category_in_view_2 = ElementsOfCategoryInView(Category=byName_2, View=activeView_2)
code_block_9 = CodeBlock { "Numeracion Fundacion"; }
exists_2 = Orchid.RevitProject.Parameters.Parameter.Exists(parameterName=code_block_9, element=all_elements_of_category_in_view_2)
filterByBoolMask_2 = List.FilterByBoolMask(list=all_elements_of_category_in_view_2, mask=exists_2)
code_block_10 = CodeBlock { "Numeracion Fundacion"; }
getParameterValueByName_2 = Element.GetParameterValueByName(element=filterByBoolMask_2.in, parameterName=code_block_10)
uniqueItems = List.UniqueItems(list=getParameterValueByName_2)
list_sortnatural = Custom[List SortNatural](list=uniqueItems)  # package Genius Loci; Sorts a specified list in natural order in either ascending or descending order.
add = code_block_7 + list_sortnatural
radiobuttons_data = Custom[RadioButtons Data](Keys=add, Values=list_sortnatural)  # package Data-Shapes; Create radio buttons input for UI.MultipleInputForm ++ .
inputgroup_data = Custom[InputGroup Data](GroupTitle=code_block_6, Inputs=radiobuttons_data)  # package Data-Shapes; Creates a group of inputs for UI.MultipleInputForm ++ . Check out www.data-shapes.net for more infos !
boolean = BoolSelector(true)
multipleinputform = Custom[MultipleInputForm ++](Description_optional=code_block_4, Logo_optional=file_path, ButtonText_optional=code_block_5.out0, Inputs=inputgroup_data, Toggle=boolean, CancelButtonText_optional=code_block_5.out1, MaxHeight_optional=code_block_5.out2, Width_optional=code_block_5.out3)  # package Data-Shapes; Create a form with multiple inputs. see www.data-shapes.net for tutorials and infos!
empty = List.Empty()
scopeIf = Custom[ScopeIf+](test=multipleinputform.Was_Cancelled, True=empty, False=multipleinputform.User_Inputs)  # package Clockwork for Dynamo 2.x; A (hopefully) more robust implementation of ScopeIf. Tests a single boolean and returns a value accordingly.
eq = getParameterValueByName == scopeIf  # lacing=Longest
filterByBoolMask_3 = List.FilterByBoolMask(list=filterByBoolMask.in, mask=eq)
python_script = Python(IN[0]=filterByBoolMask_3.in)  # IronPython2
# ---------- python_script.python (25 lines) ----------
import clr

clr.AddReference('RevitAPI')
from Autodesk.Revit.DB import *

clr.AddReference("RevitServices")
import RevitServices
from RevitServices.Persistence import DocumentManager

from System.Collections.Generic import *

uidoc = DocumentManager.Instance.CurrentUIApplication.ActiveUIDocument

def select(items):
    if isinstance(items, type(None)): # Select none
        items = []
    elif not hasattr(items, "__iter__"): # Check if single element
        items = [items]
        
    ids = List[ElementId](i.Id for i in items)
    uidoc.Selection.SetElementIds(ids)
    return "Success"
    
    
OUT = select(UnwrapElement(IN[0]))
# ----------------------------------------
