# Dynamo graph script.dyn (Dynamo 2.12.1.8246)
# packages: Data-Shapes 2022.2.96, Clockwork for Dynamo 2.x 2.3.0, Genius Loci 2021.11.10, Orchid 200.4.0.7938, Data-Shapes 2021.2.94

code_block = CodeBlock { "Text Notes"; }
byName = Category.ByName(name=code_block)
activeView = Orchid.RevitProject.Common.Document.ActiveView()
all_elements_of_category_in_view = ElementsOfCategoryInView(Category=byName, View=activeView)
text = TextNote.Text(textNote=all_elements_of_category_in_view)
code_block_2 = CodeBlock { "Busca Texto"; }
file_path = Filename("..\..\..\..\..\..\..\..\..\..\..\Arainco\Arainco.png")
code_block_3 = CodeBlock { "INICIAR"; "CANCELAR"; 850; 430; }
code_block_4 = CodeBlock { "Selecciona un Texto"; }
code_block_5 = CodeBlock { "Text Notes"; }
byName_2 = Category.ByName(name=code_block_5)
activeView_2 = Orchid.RevitProject.Common.Document.ActiveView()
all_elements_of_category_in_view_2 = ElementsOfCategoryInView(Category=byName_2, View=activeView_2)
text_2 = TextNote.Text(textNote=all_elements_of_category_in_view_2)
uniqueItems = List.UniqueItems(list=text_2)
list_sortnatural = Custom[List SortNatural](list=uniqueItems)  # package Genius Loci; Sorts a specified list in natural order in either ascending or descending order.
radiobuttons_data = Custom[RadioButtons Data](Keys=list_sortnatural, Values=list_sortnatural)  # package Data-Shapes; Create radio buttons input for UI.MultipleInputForm ++ .
inputgroup_data = Custom[InputGroup Data](GroupTitle=code_block_4, Inputs=radiobuttons_data)  # package Data-Shapes; Creates a group of inputs for UI.MultipleInputForm ++ . Check out www.data-shapes.net for more infos !
boolean = BoolSelector(true)
multipleinputform = Custom[MultipleInputForm ++](Description_optional=code_block_2, Logo_optional=file_path, ButtonText_optional=code_block_3.out0, Inputs=inputgroup_data, Toggle=boolean, CancelButtonText_optional=code_block_3.out1, MaxHeight_optional=code_block_3.out2, Width_optional=code_block_3.out3)  # package Data-Shapes; Create a form with multiple inputs. see www.data-shapes.net for tutorials and infos!
empty = List.Empty()
scopeIf = Custom[ScopeIf+](test=multipleinputform.Was_Cancelled, True=empty, False=multipleinputform.User_Inputs)  # package Clockwork for Dynamo 2.x; A (hopefully) more robust implementation of ScopeIf. Tests a single boolean and returns a value accordingly.
eq = text == scopeIf  # lacing=Longest
filterByBoolMask = List.FilterByBoolMask(list=all_elements_of_category_in_view, mask=eq)
python_script = Python(IN[0]=filterByBoolMask.out)  # IronPython2
# ---------- python_script.python (25 lines) ----------
import clr

clr.AddReference('RevitAPI')
from Autodesk.Revit.DB import *

clr.AddReference("RevitServices")
import RevitServices
from RevitServices.Persistence import DocumentManager

from System.Collections.Generic import *

uidoc = DocumentManager.Instance.CurrentUIApplication.ActiveUIDocument

def select(items):
    if isinstance(items, type(None)): # Select none
        items = []
    elif not hasattr(items, "__iter__"): # Check if single element
        items = [items]
        
    ids = List[ElementId](i.Id for i in items)
    uidoc.Selection.SetElementIds(ids)
    return "Success"
    
    
OUT = select(UnwrapElement(IN[0]))
# ----------------------------------------
