# Dynamo graph materialFilter_script.dyn (Dynamo 2.12.1.8246)
# packages: Data-Shapes 2022.2.96, Orchid 200.4.0.7938, Clockwork for Dynamo 2.x 2.4.0

activeView = Orchid.RevitProject.Common.Document.ActiveView()
code_block = CodeBlock()
# ---------- code_block.designscript (7 lines) ----------
[
"Walls",
"Structural Framing",
"Structural Columns",
"Structural Foundations",
"Floors"
];
# ----------------------------------------
byName = Category.ByName(name=code_block)
activeView_2 = Orchid.RevitProject.Common.Document.ActiveView()
all_elements_of_category_in_view = ElementsOfCategoryInView(Category=byName, View=activeView_2)
flatten = List.Flatten(list=all_elements_of_category_in_view)
code_block_2 = CodeBlock(t2=flatten)
# ---------- code_block_2.designscript (6 lines) ----------
t1 = Revit.Elements.Element.GetParameterValueByName(t2, "Type");
t3 = Revit.Elements.Element.GetParameterValueByName(t1, "Structural Material");
t4 = t3 == "";
t5 = DSCore.List.FilterByBoolMask(t2, t4);
t6 = Dictionary.ValueAtKey(t5, "in");
t7 = Dictionary.ValueAtKey(t5, "out");
# ----------------------------------------
code_block_3 = CodeBlock { "Filtrar por Materialidad"; }
file_path = Filename("..\..\..\..\..\..\..\..\..\..\..\Arainco\Arainco.png")
code_block_4 = CodeBlock()
# ---------- code_block_4.designscript (11 lines) ----------
//buttonText
"INICIAR";

//cancelButton
"CANCELAR";

//width
430;

//labelWidth
130;
# ----------------------------------------
code_block_5 = CodeBlock { "Materialidad"; }
all_elements_in_active_view = ElementsInView()
getMaterials = Element.GetMaterials(element=all_elements_in_active_view)
flatten_2 = List.Flatten(list=getMaterials@L3)
name = Material.Name(material=flatten_2@L2)
uniqueItems = List.UniqueItems(list=name@L2)
code_block_6 = CodeBlock { 0; }
radiobuttons_data = Custom[RadioButtons Data](InputName=code_block_5, Keys=uniqueItems@L2, Values=uniqueItems@L2, DefaultValueIndex=code_block_6)  # package Data-Shapes; Create radio buttons input for UI.MultipleInputForm ++ .
boolean = BoolSelector(true)
multipleinputform = Custom[MultipleInputForm ++](Description_optional=code_block_3, Logo_optional=file_path, ButtonText_optional=code_block_4.out0, Inputs=radiobuttons_data, Toggle=boolean, CancelButtonText_optional=code_block_4.out1, Width_optional=code_block_4.out2, LabelWidth_optional=code_block_4.out3)  # package Data-Shapes; Create a form with multiple inputs. see www.data-shapes.net for tutorials and infos!
code_block_7 = CodeBlock(x=multipleinputform.User_Inputs)
# ---------- code_block_7.designscript (12 lines) ----------
x;
[Imperative]
{
	if(x == null)
	{
		return = [];
	}
	else
	{
		return = x[0];
	}
};
# ----------------------------------------
getMaterials_2 = Element.GetMaterials(element=code_block_2.t7)
name_2 = Material.Name(material=getMaterials_2@L1)
eq = code_block_7.out1 == name_2  # lacing=Longest
filterByBoolMask = List.FilterByBoolMask(list=code_block_2.t7, mask=eq)
temporarilyIsolateElement = Custom[View.TemporarilyIsolateElement](view=activeView, element=filterByBoolMask.in)  # package Clockwork for Dynamo 2.x; Temporarily isolates elements in the given view
