# Dynamo graph isolateWorkset_script.dyn (Dynamo 2.12.1.8246)
# packages: Data-Shapes 2022.2.96, Orchid 200.4.0.7938, archi-lab.net 2019.2.27, Crumple 2022.2.13, Clockwork for Dynamo 2.x 2.4.0

activeView = Orchid.RevitProject.Common.Document.ActiveView()
code_block = CodeBlock { "Aislar Workset"; }
file_path = Filename("..\..\..\..\..\..\..\..\..\..\..\Arainco\Arainco.png")
code_block_2 = CodeBlock()
# ---------- code_block_2.designscript (11 lines) ----------
//buttonText
"INICIAR";

//cancelButton
"CANCELAR";

//width
430;

//labelWidth
130;
# ----------------------------------------
code_block_3 = CodeBlock { "Worksets"; }
getAll = archilab.Revit.Elements.Workset.GetAll()
name = archilab.Revit.Elements.Workset.Name(workset=getAll)
code_block_4 = CodeBlock { null; }
replaceEmptyLists = Custom[List.ReplaceEmptyLists](seq=getAll, Replacement=code_block_4)  # package Clockwork for Dynamo 2.x; Replaces all empty lists within a given list with a substitute
code_block_5 = CodeBlock(workset=replaceEmptyLists)
# ---------- code_block_5.designscript (13 lines) ----------
workset;

[Imperative]
{
	if(workset == null)
	{
		return = [];
	}
	else
	{
		return = 0;
	}
};
# ----------------------------------------
radiobuttons_data = Custom[RadioButtons Data](InputName=code_block_3, Keys=name, Values=getAll, DefaultValueIndex=code_block_5.out1)  # package Data-Shapes; Create radio buttons input for UI.MultipleInputForm ++ .
isworkshared = Custom[© IsWorkshared]()  # package Crumple; Returns if a document is workshared.
code_block_6 = CodeBlock { true; false; }
scopeIf = Custom[ScopeIf+](test=isworkshared, True=code_block_6.out0, False=code_block_6.out1)  # package Clockwork for Dynamo 2.x; A (hopefully) more robust implementation of ScopeIf. Tests a single boolean and returns a value accordingly.
multipleinputform = Custom[MultipleInputForm ++](Description_optional=code_block, Logo_optional=file_path, ButtonText_optional=code_block_2.out0, Inputs=radiobuttons_data, Toggle=scopeIf, CancelButtonText_optional=code_block_2.out1, Width_optional=code_block_2.out2, LabelWidth_optional=code_block_2.out3)  # package Data-Shapes; Create a form with multiple inputs. see www.data-shapes.net for tutorials and infos!
code_block_7 = CodeBlock(x=multipleinputform.User_Inputs, wasRun=multipleinputform.Was_Run)
# ---------- code_block_7.designscript (13 lines) ----------
x;
wasRun;
[Imperative]
{
	if(x == null || wasRun == false)
	{
		return = [];
	}
	else
	{
		return = x[0];
	}
};
# ----------------------------------------
byWorkset = archilab.Revit.Selection.Select.ByWorkset(workset=code_block_7.out2)
temporarilyIsolateElement = Custom[View.TemporarilyIsolateElement](view=activeView, element=byWorkset)  # package Clockwork for Dynamo 2.x; Temporarily isolates elements in the given view
code_block_8 = CodeBlock { "Error"; }
code_block_9 = CodeBlock(x=multipleinputform.Was_Run)
# ---------- code_block_9.designscript (12 lines) ----------
x;
[Imperative]
{
	if (x == false)
	{
		return = "El proyecto actual no es colaborativo, no contiene Worksets";
	}
	else
	{
		return = [];
	}
};
# ----------------------------------------
uimessenger = Custom[© UIMessenger](title=code_block_8, body=code_block_9.out1)  # package Crumple; Displays a message box with a title/body and OK/cancel button. If OK is selected, the third input's data will be passed through.
