# Dynamo graph script.dyn (Dynamo 2.12.1.8246)
# packages: Data-Shapes 2021.2.93, Genius Loci 2021.4.13, WombatDynamo 2.3.4, Rhythm 2021.4.2, Orchid 204.1.4.7501, Clockwork for Dynamo 2.x 2.3.0, Clockwork for Dynamo 2.x 2.4.0, Orchid 212.1.0.8161

o_document_activeview = Orchid.RevitProject.Common.Document.ActiveView()
code_block = CodeBlock { "Detalle Refuerzo Vertical"; }
file_path = Filename("B:\02_INSTALADORES\01_DYNAMO\02_OFICIALES\00_IMAGENES\editable Arainco-cmyk-01.png")
code_block_2 = CodeBlock { "INICIAR"; "CANCELAR"; 160; 450; }
code_block_3 = CodeBlock { "Seleccionar Estribos"; "SELECCIONAR"; }
code_block_4 = CodeBlock { "Lines"; }
byName = Category.ByName(name=code_block_4)
selectmodelelements_data = Custom[SelectModelElements Data](InputName=code_block_3.out0, ButtonText=code_block_3.out1, CategoryFilter=byName)  # package Data-Shapes; Creates a Revit element selection input for UI.MultipleInputForm++ . Check out www.data-shapes.net for more infos!
code_block_5 = CodeBlock { "Tipo de Estribo"; }
code_block_6 = CodeBlock()
# ---------- code_block_6.designscript (7 lines) ----------
[
"Estribo Simple",
"Estribo Doble",
"Estribo Triple",
"Estribo Cuadruple",
"Estribo Quintuple"
];
# ----------------------------------------
code_block_7 = CodeBlock()
# ---------- code_block_7.designscript (7 lines) ----------
[
"E.",
"E.D.",
"E.T.",
"E.C.",
"E.Q."
];
# ----------------------------------------
code_block_8 = CodeBlock { 0; false; }
dropdown_data = Custom[DropDown Data](InputName=code_block_5, Keys=code_block_6, Values=code_block_7, DefaultValueIndex=code_block_8.out0, Sorted_optional=code_block_8.out1)  # package Data-Shapes; Create data for DropDown input in UI.MultiInputForm ++ . Check out www.data-shapes.net for more infos.
code_block_9 = CodeBlock { "Trabas"; }
code_block_10 = CodeBlock()
# ---------- code_block_10.designscript (7 lines) ----------
[
"1 Traba",
"2 Trabas",
"3 Trabas",
"4 Trabas",
"5 Trabas"
];
# ----------------------------------------
code_block_11 = CodeBlock()
# ---------- code_block_11.designscript (7 lines) ----------
[
"+T.",
"+2T.",
"+3T.",
"+4T.",
"+5T."
];
# ----------------------------------------
code_block_12 = CodeBlock { false; }
dropdown_data_2 = Custom[DropDown Data](InputName=code_block_9, Keys=code_block_10, Values=code_block_11, Sorted_optional=code_block_12)
code_block_13 = CodeBlock { "Diametro"; }
code_block_14 = CodeBlock { "ø"; }
code_block_15 = CodeBlock()
# ---------- code_block_15.designscript (7 lines) ----------
[
6,
8,
10,
12,
16
];
# ----------------------------------------
add = code_block_14 + code_block_15
code_block_16 = CodeBlock { 1; false; }
dropdown_data_3 = Custom[DropDown Data](InputName=code_block_13, Keys=add, Values=add, DefaultValueIndex=code_block_16.out0, Sorted_optional=code_block_16.out1)
code_block_17 = CodeBlock { "Distanciamiento Estribos\nZona Extremos"; }
code_block_18 = CodeBlock()
# ---------- code_block_18.designscript (5 lines) ----------
[
"100",
"150",
"200"
];
# ----------------------------------------
code_block_19 = CodeBlock { 0; false; }
dropdown_data_4 = Custom[DropDown Data](InputName=code_block_17, Keys=code_block_18, Values=code_block_18, DefaultValueIndex=code_block_19.out0, Sorted_optional=code_block_19.out1)
code_block_20 = CodeBlock { "Distanciamiento Estribos\nZona Central"; }
code_block_21 = CodeBlock()  # same code as code_block_18
code_block_22 = CodeBlock { 2; false; }
dropdown_data_5 = Custom[DropDown Data](InputName=code_block_20, Keys=code_block_21, Values=code_block_21, DefaultValueIndex=code_block_22.out0, Sorted_optional=code_block_22.out1)
code_block_23 = CodeBlock { "Selecciona la Posicion\ndel Detalle"; "SELECCIONAR"; }
selectpointsonface_data = Custom[SelectPointsOnFace data](InputName=code_block_23.out0, ButtonText=code_block_23.out1)  # package Data-Shapes; Creates a UI.MultipleInputForm++ input that allows point on face selection
list_create = List.Create(item0=selectmodelelements_data, item1=dropdown_data, item2=dropdown_data_2, item3=dropdown_data_3, item4=dropdown_data_4, item5=dropdown_data_5, item6=selectpointsonface_data)
boolean = BoolSelector(true)
multipleinputform = Custom[MultipleInputForm ++](Description_optional=code_block, Logo_optional=file_path, ButtonText_optional=code_block_2.out0, Inputs=list_create, Toggle=boolean, CancelButtonText_optional=code_block_2.out1, Width_optional=code_block_2.out3, LabelWidth_optional=code_block_2.out2)  # package Data-Shapes; Create a form with multiple inputs. see www.data-shapes.net for tutorials and infos!
nullItem = WombatDynamo.List.NullItem()
if_ = If(test=multipleinputform.Was_Cancelled, true=nullItem, false=multipleinputform.User_Inputs)
code_block_24 = CodeBlock { ""; }
replaceNull = Custom[List.ReplaceNull](seq=if_, replacement=code_block_24)  # package Clockwork for Dynamo 2.x; Replaces all null values within a given list with a substitute
code_block_25 = CodeBlock(l=replaceNull) { l[0]; }
code_block_26 = CodeBlock { "Line Style"; }
getParameterValueByName = Element.GetParameterValueByName(element=code_block_25, parameterName=code_block_26)
name = Element.Name(element=getParameterValueByName)
code_block_27 = CodeBlock { "C-ESTRIBOS"; }
eq = name == code_block_27
filterByBoolMask = List.FilterByBoolMask(list=code_block_25, mask=eq)
flatten = List.Flatten(list=filterByBoolMask.in)
geometry = Element.Geometry(element=flatten)
flatten_2 = List.Flatten(list=geometry)
code_block_28 = CodeBlock { 0.5; }
pointAtParameter = Curve.PointAtParameter(curve=flatten_2, param=code_block_28)
byBestFitThroughPoints = Line.ByBestFitThroughPoints(bestFitPoints=pointAtParameter)
o_document_activeview_2 = Orchid.RevitProject.Common.Document.ActiveView()
plane = Custom[View.Plane](view=o_document_activeview_2)  # package Clockwork for Dynamo 2.x; Retrieves the plane of a given view
pullOntoPlane = Curve.PullOntoPlane(curve=byBestFitThroughPoints, plane=plane)
element_reference = Custom[Element Reference](element=flatten)  # package Genius Loci; Gets the reference of a geometric object or a dimension or a reference plane.
converted_from_dropdown_with = CodeBlock { DSCore.Types.FindTypeByNameInAssembly("DimensionType", "RevitAPI"); }  # "Converted from Dropdown with Monocle™"
all_elements_of_type = ElementsOfType(element_type=converted_from_dropdown_with)
name_2 = Element.Name(element=all_elements_of_type)
code_block_29 = CodeBlock { "EST_DETALLE_ESTRIBOS Y TRABAS"; }
eq_2 = name_2 == code_block_29
filterByBoolMask_2 = List.FilterByBoolMask(list=all_elements_of_type, mask=eq_2)
dimension_byreferences = Custom[Dimension ByReferences](view=o_document_activeview, line=pullOntoPlane, references=element_reference, dimensionType=filterByBoolMask_2.in)  # package Genius Loci; Creates a new linear dimension from at least two geometric references of an object.
end = Revit.Transaction.Transaction.End(input=dimension_byreferences)
code_block_30 = CodeBlock(l=replaceNull) { l[1]+l[2]+l[3]+"@"+l[4]; }
ʳʰʸᵗʰᵐ_dimensions_setabovevalue = Rhythm.Revit.Elements.Dimensions.SetAboveValue(dimension=end, aboveValue=code_block_30)
code_block_31 = CodeBlock(l=replaceNull) { l[6]; }
element_setlocation = Custom[Element SetLocation](element=ʳʰʸᵗʰᵐ_dimensions_setabovevalue.set, location=code_block_31)  # package Genius Loci; Modify the location of the given element. (Same as the Move command in Revit.) Works for point/ line/ sketch based elements, view-specific elements, groups and link instances.
ʳʰʸᵗʰᵐ_dimensions_abovevalue = Rhythm.Revit.Elements.Dimensions.AboveValue(dimension=ʳʰʸᵗʰᵐ_dimensions_setabovevalue.set)
flatten_3 = List.Flatten(list=ʳʰʸᵗʰᵐ_dimensions_abovevalue)
count = List.Count(list=flatten_3)
code_block_32 = CodeBlock(n=count) { 1..n-1..2; }
code_block_33 = CodeBlock { l[4]; l[5]; }  # unwired: l
replace = Orchid.Common.String.Replace(string=flatten_3, searchFor=code_block_33.out0, replaceWith=code_block_33.out1)
uniqueItems = List.UniqueItems(list=replace)
replaceItemAtIndex = Custom[List.ReplaceItemAtIndex+](seq=flatten_3, indices=code_block_32, replacement=uniqueItems)  # package Clockwork for Dynamo 2.x; Replaces the item at a given index of a list by another item. Unlike the OOTB node, it can replace items at multiple indeces.
ʳʰʸᵗʰᵐ_dimensions_setabovevalue_2 = Rhythm.Revit.Elements.Dimensions.SetAboveValue(dimension=element_setlocation, aboveValue=replaceItemAtIndex)
code_block_34 = CodeBlock { "Leader"; 0; }
setParameterByName = Element.SetParameterByName(element=ʳʰʸᵗʰᵐ_dimensions_setabovevalue_2.set, parameterName=code_block_34.out0, value=code_block_34.out1)
ʳʰʸᵗʰᵐ_dimensions_getcurve = Rhythm.Revit.Elements.Dimensions.GetCurve(dimension=setParameterByName)
code_block_35 = CodeBlock { 0.5; }
pointAtParameter_2 = Curve.PointAtParameter(curve=ʳʰʸᵗʰᵐ_dimensions_getcurve, param=code_block_35)
code_block_36 = CodeBlock { "50"; }
code_block_37 = CodeBlock { 190; }
byKeysValues = DesignScript.Builtin.Dictionary.ByKeysValues(keys=code_block_36, values=code_block_37)
o_document_activeview_3 = Orchid.RevitProject.Common.Document.ActiveView()
code_block_38 = CodeBlock { "View Scale"; }
getParameterValueByName_2 = Element.GetParameterValueByName(element=o_document_activeview_3, parameterName=code_block_38)
string_from_object = FromObject(obj=getParameterValueByName_2)
valueAtKey = DesignScript.Builtin.Dictionary.ValueAtKey(dictionary=byKeysValues, key=string_from_object)
translate = Geometry.Translate(geometry=pointAtParameter_2, xTranslation=valueAtKey, yTranslation=valueAtKey)
ʳʰʸᵗʰᵐ_dimensions = Rhythm.Revit.Elements.Dimensions.SetTextLocation(dimension=ʳʰʸᵗʰᵐ_dimensions_setabovevalue_2.set, locationPoint=translate)
string = StringInput("L=")
setPrefix = Dimension.SetPrefix(dimension=setParameterByName, values=string)
