# Dynamo graph script.dyn (Dynamo 2.12.1.8246)
# packages: Clockwork for Dynamo 2.x 2.3.0, Data-Shapes 2021.2.93, MEPover 2020.6.2, Orchid 204.1.4.7501, Genius Loci 2021.4.13, WombatDynamo 2.3.4, Rhythm 2021.4.2, Orchid 212.1.0.8161

current = Document.Current()
activeView = Document.ActiveView(document=current)
code_block = CodeBlock { "Barra Vertical Recta Empalmada"; }
file_path = Filename("..\00_IMAGENES\editable Arainco-cmyk-01.png")
code_block_2 = CodeBlock { 150; "INICIAR"; "CANCELAR"; }
code_block_3 = CodeBlock { "Diametro de Barras"; }
code_block_4 = CodeBlock { "EST_D_BARRA VERTICAL_IZQUIERDA_RECTA EMPALMADA"; }
byName = Family.ByName(name=code_block_4)
family_types_of_family = Custom[Family types of family](family=byName)  # package MEPover; Returns every family type of the given Family
sortNatural = Orchid.Common.List.SortNatural(list=family_types_of_family)
name = Element.Name(element=sortNatural)
code_block_5 = CodeBlock { 4; }
code_block_6 = CodeBlock { false; }
dropdown_data = Custom[DropDown Data](InputName=code_block_3, Keys=name, Values=sortNatural, DefaultValueIndex=code_block_5, Sorted_optional=code_block_6)  # package Data-Shapes; Create data for DropDown input in UI.MultiInputForm ++ . Check out www.data-shapes.net for more infos.
code_block_7 = CodeBlock { "Cantidad de Barras"; }
code_block_8 = CodeBlock { 1..10..1; 1; }
code_block_9 = CodeBlock { false; }
dropdown_data_2 = Custom[DropDown Data](InputName=code_block_7, Keys=code_block_8.out0, Values=code_block_8.out0, DefaultValueIndex=code_block_8.out1, Sorted_optional=code_block_9)
code_block_10 = CodeBlock { "Barra A Empalmar"; }
code_block_11 = CodeBlock { "SELECCIONAR"; }
code_block_12 = CodeBlock { "Detail Items"; }
byName_2 = Category.ByName(name=code_block_12)
code_block_13 = CodeBlock { true; }
selectmodelelements_data = Custom[SelectModelElements Data](InputName=code_block_10, ButtonText=code_block_11, CategoryFilter=byName_2, SelectSingleElement=code_block_13)  # package Data-Shapes; Creates a Revit element selection input for UI.MultipleInputForm++ . Check out www.data-shapes.net for more infos!
list_create = List.Create(item0=dropdown_data, item1=dropdown_data_2, item2=selectmodelelements_data)
boolean = BoolSelector(true)
multipleinputform = Custom[MultipleInputForm ++](Description_optional=code_block, Logo_optional=file_path, ButtonText_optional=code_block_2.out1, Inputs=list_create, Toggle=boolean, CancelButtonText_optional=code_block_2.out2, LabelWidth_optional=code_block_2.out0)  # package Data-Shapes; Create a form with multiple inputs. see www.data-shapes.net for tutorials and infos!
nullItem = WombatDynamo.List.NullItem()
if_ = If(test=multipleinputform.Was_Cancelled, true=nullItem, false=multipleinputform.User_Inputs)
code_block_14 = CodeBlock(l=if_) { l[2]; }
code_block_15 = CodeBlock { "Family"; }
getParameterValueByName = Element.GetParameterValueByName(element=code_block_14, parameterName=code_block_15)
string_from_object = FromObject(obj=getParameterValueByName)
code_block_16 = CodeBlock { "Family: "; }
split = String.Split(string=string_from_object, separator0=code_block_16)
code_block_17 = CodeBlock { 1; }
getItemAtIndex = List.GetItemAtIndex(list=split, index=code_block_17)
string = StringInput("EST_D_BARRA VERTICAL_IZQUIERDA_RECTA EMPOTRADA")
eq = getItemAtIndex == string
filterByBoolMask = List.FilterByBoolMask(list=code_block_14, mask=eq)
familyinstance_2d_geometry = Custom[FamilyInstance 2D Geometry](element=filterByBoolMask.out)  # package Genius Loci; Gets the curves of the family instance. Works only with the family categories : Generic Annotation and Detail Item.
code_block_18 = CodeBlock { 0; }
getItemAtIndex_2 = List.GetItemAtIndex(list=familyinstance_2d_geometry@L2, index=code_block_18)
endPoint = Curve.EndPoint(curve=getItemAtIndex_2)
code_block_19 = CodeBlock(l=if_) { l[0]; }
current_2 = Document.Current()
activeView_2 = Document.ActiveView(document=current_2)
byPointInView = Custom[FamilyInstance.ByPointInView](point=endPoint, familyType=code_block_19, view=activeView_2)  # package Clockwork for Dynamo 2.x; Places a family instance at a given point in a given view (e.g. a detail component).
code_block_20 = CodeBlock { "Cantidad de Barras"; }
code_block_21 = CodeBlock(l=if_) { l[1]; }
setParameterByName = Element.SetParameterByName(element=byPointInView, parameterName=code_block_20, value=code_block_21)
end = Revit.Transaction.Transaction.End(input=setParameterByName)
converted_from_dropdown_with = CodeBlock { DSCore.Types.FindTypeByNameInAssembly("DimensionType", "RevitAPI"); }  # "Converted from Dropdown with Monocle™"
all_elements_of_type = ElementsOfType(element_type=converted_from_dropdown_with)
name_2 = Element.Name(element=all_elements_of_type)
code_block_22 = CodeBlock { "EST_EMPALME"; }
eq_2 = name_2 == code_block_22
filterByBoolMask_2 = List.FilterByBoolMask(list=all_elements_of_type, mask=eq_2)

# group: EMPALMES
familyinstance_2d_geometry_2 = Custom[FamilyInstance 2D Geometry](element=end)
code_block_23 = CodeBlock { 2; }
getItemAtIndex_3 = List.GetItemAtIndex(list=familyinstance_2d_geometry_2@L2, index=code_block_23)
familyinstance_references = Custom[FamilyInstance References](familyInstance=end)  # package Genius Loci; Returns all references and references names.
code_block_24 = CodeBlock { "Empalme"; }
contains = Orchid.Common.String.Contains(string=familyinstance_references.ReferenceName, searchFor=code_block_24)
filterByBoolMask_3 = List.FilterByBoolMask(list=familyinstance_references.Reference, mask=contains)
dimension_byreferences = Custom[Dimension ByReferences](view=activeView, line=getItemAtIndex_3, references=filterByBoolMask_3.in, dimensionType=filterByBoolMask_2.in, lacing=Longest)  # package Genius Loci; Creates a new linear dimension from at least two geometric references of an object.

ʳʰʸᵗʰᵐ_dimensions_getcurve = Rhythm.Revit.Elements.Dimensions.GetCurve(dimension=dimension_byreferences)
flatten = List.Flatten(list=ʳʰʸᵗʰᵐ_dimensions_getcurve)
code_block_25 = CodeBlock { 0.5; }
pointAtParameter = Curve.PointAtParameter(curve=flatten, param=code_block_25)
code_block_26 = CodeBlock { -250; }
translate = Geometry.Translate(geometry=pointAtParameter, xTranslation=code_block_26, yTranslation=code_block_26)
element_setlocation = Custom[Element SetLocation](element=dimension_byreferences, location=translate)  # package Genius Loci; Modify the location of the given element. (Same as the Move command in Revit.) Works for point/ line/ sketch based elements, view-specific elements, groups and link instances.
current_3 = Document.Current()
activeView_3 = Document.ActiveView(document=current_3)
familyinstance_2d_geometry_3 = Custom[FamilyInstance 2D Geometry](element=filterByBoolMask.in)
code_block_27 = CodeBlock { 1; }
getItemAtIndex_4 = List.GetItemAtIndex(list=familyinstance_2d_geometry_3@L2, index=code_block_27)
endPoint_2 = Curve.EndPoint(curve=getItemAtIndex_4)
o_document_activeview = Orchid.RevitProject.Common.Document.ActiveView()
byPointInView_2 = Custom[FamilyInstance.ByPointInView](point=endPoint_2, familyType=code_block_19, view=o_document_activeview)
code_block_28 = CodeBlock { "Cantidad de Barras"; }
setParameterByName_2 = Element.SetParameterByName(element=byPointInView_2, parameterName=code_block_28, value=code_block_21)
end_2 = Revit.Transaction.Transaction.End(input=setParameterByName_2)
converted_from_dropdown_with_2 = CodeBlock { DSCore.Types.FindTypeByNameInAssembly("DimensionType", "RevitAPI"); }  # "Converted from Dropdown with Monocle™"
all_elements_of_type_2 = ElementsOfType(element_type=converted_from_dropdown_with_2)
name_3 = Element.Name(element=all_elements_of_type_2)
code_block_29 = CodeBlock { "EST_EMPALME"; }
eq_3 = name_3 == code_block_29
filterByBoolMask_4 = List.FilterByBoolMask(list=all_elements_of_type_2, mask=eq_3)

# group: EMPALMES
familyinstance_2d_geometry_4 = Custom[FamilyInstance 2D Geometry](element=end_2)
code_block_30 = CodeBlock { 2; }
getItemAtIndex_5 = List.GetItemAtIndex(list=familyinstance_2d_geometry_4@L2, index=code_block_30)
familyinstance_references_2 = Custom[FamilyInstance References](familyInstance=end_2)
code_block_31 = CodeBlock { "Empalme"; }
contains_2 = Orchid.Common.String.Contains(string=familyinstance_references_2.ReferenceName, searchFor=code_block_31)
filterByBoolMask_5 = List.FilterByBoolMask(list=familyinstance_references_2.Reference, mask=contains_2)
dimension_byreferences_2 = Custom[Dimension ByReferences](view=activeView_3, line=getItemAtIndex_5, references=filterByBoolMask_5.in, dimensionType=filterByBoolMask_4.in, lacing=Longest)

ʳʰʸᵗʰᵐ_dimensions_getcurve_2 = Rhythm.Revit.Elements.Dimensions.GetCurve(dimension=dimension_byreferences_2)
code_block_32 = CodeBlock { 0.5; }
pointAtParameter_2 = Curve.PointAtParameter(curve=ʳʰʸᵗʰᵐ_dimensions_getcurve_2, param=code_block_32)
code_block_33 = CodeBlock { -250; }
translate_2 = Geometry.Translate(geometry=pointAtParameter_2, xTranslation=code_block_33, yTranslation=code_block_33)
element_setlocation_2 = Custom[Element SetLocation](element=dimension_byreferences_2, location=translate_2)
current_4 = Document.Current()
activeView_4 = Document.ActiveView(document=current_4)
familyinstance_2d_geometry_5 = Custom[FamilyInstance 2D Geometry](element=end_2)
code_block_34 = CodeBlock { 0; }
getItemAtIndex_6 = List.GetItemAtIndex(list=familyinstance_2d_geometry_5@L2, index=code_block_34)
code_block_35 = CodeBlock { 0.5; }
pointAtParameter_3 = Curve.PointAtParameter(curve=getItemAtIndex_6, param=code_block_35)
code_block_36 = CodeBlock { "Barra Vertical Recta"; }
byName_3 = FamilyType.ByName(name=code_block_36)
code_block_37 = CodeBlock { true; }
boolean_2 = BoolSelector(true)
create_tag = Custom[Create Tag](view=activeView_4, element=end_2, TagLocation=pointAtParameter_3, TagType=byName_3, addLeader=code_block_37, RunIt=boolean_2)  # package Genius Loci; Works only in Revit 2018 and later. Creates a tag at a given location, of given type and in a supplied view. The node also works with Linked Elements (except space and area), Multi Category tag and Material Tag. Based on an archilab node
tag_getlocation = Custom[Tag GetLocation](tag=create_tag)  # package Genius Loci; Retrieves the position of the head of tag.
code_block_38 = CodeBlock { -25; }
translate_3 = Geometry.Translate(geometry=tag_getlocation, xTranslation=code_block_38, yTranslation=code_block_38)
tag_setlocation = Custom[Tag SetLocation](tag=create_tag, location=translate_3)  # package Genius Loci; Moves the head of the tag to the given location point.
end_3 = Revit.Transaction.Transaction.End(input=tag_setlocation)
code_block_39 = CodeBlock { "Leader Type"; 1; }
setParameterByName_3 = Element.SetParameterByName(element=end_3, parameterName=code_block_39.out0, value=code_block_39.out1)
current_5 = Document.Current()
activeView_5 = Document.ActiveView(document=current_5)
familyinstance_2d_geometry_6 = Custom[FamilyInstance 2D Geometry](element=end)
code_block_40 = CodeBlock { 0; }
getItemAtIndex_7 = List.GetItemAtIndex(list=familyinstance_2d_geometry_6@L2, index=code_block_40)
code_block_41 = CodeBlock { 0.5; }
pointAtParameter_4 = Curve.PointAtParameter(curve=getItemAtIndex_7, param=code_block_41)
code_block_42 = CodeBlock { "Barra Vertical Recta"; }
byName_4 = FamilyType.ByName(name=code_block_42)
code_block_43 = CodeBlock { true; }
boolean_3 = BoolSelector(true)
create_tag_2 = Custom[Create Tag](view=activeView_5, element=end, TagLocation=pointAtParameter_4, TagType=byName_4, addLeader=code_block_43, RunIt=boolean_3)
tag_getlocation_2 = Custom[Tag GetLocation](tag=create_tag_2)
code_block_44 = CodeBlock { -25; }
translate_4 = Geometry.Translate(geometry=tag_getlocation_2, xTranslation=code_block_44, yTranslation=code_block_44)
tag_setlocation_2 = Custom[Tag SetLocation](tag=create_tag_2, location=translate_4)
end_4 = Revit.Transaction.Transaction.End(input=tag_setlocation_2)
code_block_45 = CodeBlock { "Leader Type"; 1; }
setParameterByName_4 = Element.SetParameterByName(element=end_4, parameterName=code_block_45.out0, value=code_block_45.out1)
