# Dynamo graph script.dyn (Dynamo 2.12.1.8246)
# packages: Rhythm 2022.1.1, Clockwork for Dynamo 2.x 2.4.0, Genius Loci 2022.4.19, Data-Shapes 2022.2.103, WombatDynamo 2.3.5, Orchid 212.1.0.8161

o_document_activeview = Orchid.RevitProject.Common.Document.ActiveView()
all_elements_in_active_view = ElementsInView()
string = StringInput("Structural Framing")
string_2 = StringInput("Equals")
ʳʰʸᵗʰᵐ_elementfilter_bycategory = Rhythm.Revit.ElementFilter.ElementFilter.ByCategory(elements=all_elements_in_active_view, category=string, filterMethod=string_2)
element_locationcurve = Custom[Element LocationCurve](element=ʳʰʸᵗʰᵐ_elementfilter_bycategory)  # package Genius Loci; Gets the curve geometry from the element.
startPoint = Curve.StartPoint(curve=element_locationcurve)
endPoint = Curve.EndPoint(curve=element_locationcurve)
byTwoPoints = Vector.ByTwoPoints(start=startPoint, end=endPoint)
o_document_activeview_2 = Orchid.RevitProject.Common.Document.ActiveView()
plane = Custom[View.Plane](view=o_document_activeview_2)  # package Clockwork for Dynamo 2.x; Retrieves the plane of a given view
isParallelToPlane = Custom[Vector.IsParallelToPlane](vector=byTwoPoints, plane=plane)  # package Clockwork for Dynamo 2.x; Checks if a given vector is parallel to a given plane
filterByBoolMask = List.FilterByBoolMask(list=ʳʰʸᵗʰᵐ_elementfilter_bycategory, mask=isParallelToPlane)
element_taggedstatus = Custom[Element TaggedStatus](element=filterByBoolMask.in)  # package Genius Loci; Identify the tagged and untagged elements. Please note : This doesn't work with areas and spaces.
string_3 = StringInput("Diametro Estribos")
code_block = CodeBlock { "Etiquetado Vigas"; }
file_path = Filename("..\..\..\00_IMAGENES\editable Arainco-cmyk-01.png")
code_block_2 = CodeBlock { "INICIAR"; "CANCELAR"; 200; }
code_block_3 = CodeBlock { "Diametro Estribos"; }
code_block_4 = CodeBlock { "ø"; }
code_block_5 = CodeBlock()
# ---------- code_block_5.designscript (13 lines) ----------
[
6,
8,
10,
12,
16,
18,
22,
25,
28,
32,
36
];
# ----------------------------------------
add = code_block_4 + code_block_5
code_block_6 = CodeBlock { 3; }
code_block_7 = CodeBlock { false; }
dropdown_data = Custom[DropDown Data](InputName=code_block_3, Keys=add, Values=code_block_5, DefaultValueIndex=code_block_6, Sorted_optional=code_block_7)  # package Data-Shapes; Create data for DropDown input in UI.MultiInputForm ++ . Check out www.data-shapes.net for more infos.
code_block_8 = CodeBlock { "Distanciamiento Estribos"; }
code_block_9 = CodeBlock()
# ---------- code_block_9.designscript (7 lines) ----------
[
100,
120,
150,
200,
250
];
# ----------------------------------------
code_block_10 = CodeBlock { 0; }
code_block_11 = CodeBlock { false; }
dropdown_data_2 = Custom[DropDown Data](InputName=code_block_8, Keys=code_block_9, Values=code_block_9, DefaultValueIndex=code_block_10, Sorted_optional=code_block_11)
code_block_12 = CodeBlock { "Diametro Laterales"; }
code_block_13 = CodeBlock { "ø"; }
code_block_14 = CodeBlock()  # same code as code_block_5
add_2 = code_block_13 + code_block_14
code_block_15 = CodeBlock { 3; }
code_block_16 = CodeBlock { false; }
dropdown_data_3 = Custom[DropDown Data](InputName=code_block_12, Keys=add_2, Values=code_block_14, DefaultValueIndex=code_block_15, Sorted_optional=code_block_16)
string_4 = StringInput("NOTA:")
string_5 = StringInput("La cantidad de laterales sera calculada a razon de la Altura de la Viga dividida en 200mm.")
textnote_data = Custom[TextNote Data](Title=string_4, TextNote=string_5)  # package Data-Shapes; Create Data for TextNote input in UI.MultipleInputForm ++ . Check out www.data-shapes.net for more informations
list_create = List.Create(item0=dropdown_data, item1=dropdown_data_2, item2=dropdown_data_3, item3=textnote_data)
boolean = BoolSelector(true)
multipleinputform = Custom[MultipleInputForm ++](Description_optional=code_block, Logo_optional=file_path, ButtonText_optional=code_block_2.out0, Inputs=list_create, Toggle=boolean, CancelButtonText_optional=code_block_2.out1, LabelWidth_optional=code_block_2.out2)  # package Data-Shapes; Create a form with multiple inputs. see www.data-shapes.net for tutorials and infos!
nullItem = WombatDynamo.List.NullItem()
if_ = If(test=multipleinputform.Was_Cancelled, true=nullItem, false=multipleinputform.User_Inputs)  # frozen
code_block_17 = CodeBlock { 0; }
getItemAtIndex = List.GetItemAtIndex(list=if_, index=code_block_17)
setParameterByName = Element.SetParameterByName(element=element_taggedstatus.NotTagged, parameterName=string_3, value=getItemAtIndex)
string_6 = StringInput("Distanciamiento Estribo")
code_block_18 = CodeBlock { 1; }
getItemAtIndex_2 = List.GetItemAtIndex(list=if_, index=code_block_18)
setParameterByName_2 = Element.SetParameterByName(element=setParameterByName, parameterName=string_6, value=getItemAtIndex_2)
string_7 = StringInput("Diametro Laterales")
code_block_19 = CodeBlock { 2; }
getItemAtIndex_3 = List.GetItemAtIndex(list=if_, index=code_block_19)
setParameterByName_3 = Element.SetParameterByName(element=setParameterByName_2, parameterName=string_7, value=getItemAtIndex_3)
string_8 = StringInput("Cantidad de Laterales")
string_9 = StringInput("Type")
getParameterValueByName = Element.GetParameterValueByName(element=setParameterByName_3, parameterName=string_9)
string_10 = StringInput("Height")
getParameterValueByName_2 = Element.GetParameterValueByName(element=getParameterValueByName, parameterName=string_10)
code_block_20 = CodeBlock { 200; }
div = getParameterValueByName_2 / code_block_20
code_block_21 = CodeBlock { 1; }
sub = div - code_block_21
setParameterByName_4 = Element.SetParameterByName(element=setParameterByName_3, parameterName=string_8, value=sub)
geometry = Element.Geometry(element=element_taggedstatus.NotTagged)
string_from_object = FromObject(obj=geometry)
code_block_22 = CodeBlock { "Solid"; }
eq = string_from_object@L2 == code_block_22  # lacing=Longest
filterByBoolMask_2 = List.FilterByBoolMask(list=geometry, mask=eq)
flatten = List.Flatten(list=filterByBoolMask_2.in)
centroid = Solid.Centroid(solid=flatten)
code_block_23 = CodeBlock { "Elevacion - Estribo Simple y Laterales"; }
byName = FamilyType.ByName(name=code_block_23)
boolean_2 = BoolSelector(true)
create_tag = Custom[Create Tag](view=o_document_activeview, element=setParameterByName_4, TagLocation=centroid, TagType=byName, RunIt=boolean_2)  # package Genius Loci; Works only in Revit 2018 and later. Creates a tag at a given location, of given type and in a supplied view. The node also works with Linked Elements (except space and area), Multi Category tag and Material Tag. Based on an archilab node
o_document_activeview_3 = Orchid.RevitProject.Common.Document.ActiveView()
code_block_24 = CodeBlock { 2; }
div_2 = getParameterValueByName_2 / code_block_24
code_block_25 = CodeBlock { 500; }
add_3 = div_2 + code_block_25
translate = Geometry.Translate(geometry=centroid, zTranslation=add_3)
code_block_26 = CodeBlock { "Elevacion  - Tipo de Viga"; }
byName_2 = FamilyType.ByName(name=code_block_26)
boolean_3 = BoolSelector(true)
create_tag_2 = Custom[Create Tag](view=o_document_activeview_3, element=setParameterByName_4, TagLocation=translate, TagType=byName_2, RunIt=boolean_3)
