# Dynamo graph script.dyn (Dynamo 2.12.1.8246)
# packages: Data-Shapes 2021.2.93, WombatDynamo 2.3.4, Genius Loci 2021.4.13, Rhythm 2021.4.2, Clockwork for Dynamo 2.x 2.3.0, Genius Loci 2021.11.10, Orchid 212.1.0.8161

o_document_activeview = Orchid.RevitProject.Common.Document.ActiveView()
code_block = CodeBlock { "Igualdad de Vigas"; }
file_path = Filename("B:\02_INSTALADORES\01_DYNAMO\02_OFICIALES\00_IMAGENES\editable Arainco-cmyk-01.png")
code_block_2 = CodeBlock { "INICIAR"; "CANCELAR"; 160; 400; }
code_block_3 = CodeBlock { "Selecciona Vigas Iguales"; "SELECCIONAR"; }
code_block_4 = CodeBlock { "Structural Framing"; }
byName = Category.ByName(name=code_block_4)
selectmodelelements_data = Custom[SelectModelElements Data](InputName=code_block_3.out0, ButtonText=code_block_3.out1, CategoryFilter=byName)  # package Data-Shapes; Creates a Revit element selection input for UI.MultipleInputForm++ . Check out www.data-shapes.net for more infos!
boolean = BoolSelector(true)
multipleinputform = Custom[MultipleInputForm ++](Description_optional=code_block, Logo_optional=file_path, ButtonText_optional=code_block_2.out0, Inputs=selectmodelelements_data, Toggle=boolean, CancelButtonText_optional=code_block_2.out1, Width_optional=code_block_2.out3, LabelWidth_optional=code_block_2.out2)  # package Data-Shapes; Create a form with multiple inputs. see www.data-shapes.net for tutorials and infos!
nullItem = WombatDynamo.List.NullItem()
if_ = If(test=multipleinputform.Was_Cancelled, true=nullItem, false=multipleinputform.User_Inputs)
code_block_5 = CodeBlock(l=if_) { l[0]; }
geometry = Element.Geometry(element=code_block_5)
centroid = Solid.Centroid(solid=geometry)
flatten = List.Flatten(list=centroid)
list_clean = Custom[List Clean](list=flatten)  # package Genius Loci; Removes all Null, Empty and Blank from a list or nested list of lists.
byBestFitThroughPoints = Line.ByBestFitThroughPoints(bestFitPoints=list_clean)
o_document_activeview_2 = Orchid.RevitProject.Common.Document.ActiveView()
plane = Custom[View.Plane](view=o_document_activeview_2)  # package Clockwork for Dynamo 2.x; Retrieves the plane of a given view
pullOntoPlane = Curve.PullOntoPlane(curve=byBestFitThroughPoints, plane=plane)
familyinstance_references = Custom[FamilyInstance References](familyInstance=code_block_5)  # package Genius Loci; Returns all references and references names.
code_block_6 = CodeBlock { 3; }
getItemAtIndex = List.GetItemAtIndex(list=familyinstance_references.Reference@L2, index=code_block_6)
converted_from_dropdown_with = CodeBlock { DSCore.Types.FindTypeByNameInAssembly("DimensionType", "RevitAPI"); }  # "Converted from Dropdown with Monocle™"
all_elements_of_type = ElementsOfType(element_type=converted_from_dropdown_with)
name = Element.Name(element=all_elements_of_type)
code_block_7 = CodeBlock { "EST_IGUALDAD VIGA"; }
eq = name == code_block_7
filterByBoolMask = List.FilterByBoolMask(list=all_elements_of_type, mask=eq)
dimension_byreferences = Custom[Dimension ByReferences](view=o_document_activeview, line=pullOntoPlane, references=getItemAtIndex, dimensionType=filterByBoolMask.in)  # package Genius Loci; Creates a new linear dimension from at least two geometric references of an object.
code_block_8 = CodeBlock { "IDEM"; }
ʳʰʸᵗʰᵐ_dimensions_setbelowvalue = Rhythm.Revit.Elements.Dimensions.SetBelowValue(dimension=dimension_byreferences, belowValue=code_block_8)
code_block_9 = CodeBlock { "Leader"; 0; }
setParameterByName = Element.SetParameterByName(element=ʳʰʸᵗʰᵐ_dimensions_setbelowvalue.set, parameterName=code_block_9.out0, value=code_block_9.out1)
ʳʰʸᵗʰᵐ_dimensions = Rhythm.Revit.Elements.Dimensions.CenterTextOnLine(dimension=setParameterByName)
code_block_10 = CodeBlock { "ARMADURA"; }
setValueOverride = Dimension.SetValueOverride(dimension=dimension_byreferences, values=code_block_10)
