# Dynamo graph script.dyn (Dynamo 2.12.1.8246)
# packages: Clockwork for Dynamo 2.x 2.3.0, Data-Shapes 2021.2.93, MEPover 2020.6.2, Orchid 204.1.4.7501, Genius Loci 2021.4.13, WombatDynamo 2.3.4, Rhythm 2021.4.2, archi-lab.net 2021.25.2621, Orchid 200.4.0.7938, Genius Loci 2022.4.19, Rhythm 2022.1.1, Orchid 2.12.5.6080, Clockwork for Dynamo 2.x 2.4.0

code_block = CodeBlock { "Primera Capa - Barra Empalmada Recta"; }
file_path = Filename("..\00_IMAGENES\editable Arainco-cmyk-01.png")
code_block_2 = CodeBlock { 150; "INICIAR"; "CANCELAR"; }
code_block_3 = CodeBlock { "Diametro de Barras"; }
code_block_4 = CodeBlock { "EST_D_VIGA_BARRA HORIZONTAL_INFERIOR_RECTA"; }
byName = Family.ByName(name=code_block_4)
family_types_of_family = Custom[Family types of family](family=byName)  # package MEPover; Returns every family type of the given Family
sortNatural = Orchid.Common.List.SortNatural(list=family_types_of_family)
name = Element.Name(element=sortNatural)
code_block_5 = CodeBlock { 4; }
code_block_6 = CodeBlock { false; }
dropdown_data = Custom[DropDown Data](InputName=code_block_3, Keys=name, Values=sortNatural, DefaultValueIndex=code_block_5, Sorted_optional=code_block_6)  # package Data-Shapes; Create data for DropDown input in UI.MultiInputForm ++ . Check out www.data-shapes.net for more infos.
code_block_7 = CodeBlock { "Cantidad de Barras"; }
code_block_8 = CodeBlock { 1..10..1; 1; }
code_block_9 = CodeBlock { false; }
dropdown_data_2 = Custom[DropDown Data](InputName=code_block_7, Keys=code_block_8.out0, Values=code_block_8.out0, DefaultValueIndex=code_block_8.out1, Sorted_optional=code_block_9)
code_block_10 = CodeBlock { "Barra A Empalmar"; }
code_block_11 = CodeBlock { "SELECCIONAR"; }
code_block_12 = CodeBlock { "Detail Items"; }
byName_2 = Category.ByName(name=code_block_12)
code_block_13 = CodeBlock { true; }
selectmodelelements_data = Custom[SelectModelElements Data](InputName=code_block_10, ButtonText=code_block_11, CategoryFilter=byName_2, SelectSingleElement=code_block_13)  # package Data-Shapes; Creates a Revit element selection input for UI.MultipleInputForm++ . Check out www.data-shapes.net for more infos!
list_create = List.Create(item0=dropdown_data, item1=dropdown_data_2, item2=selectmodelelements_data)
boolean = BoolSelector(true)
multipleinputform = Custom[MultipleInputForm ++](Description_optional=code_block, Logo_optional=file_path, ButtonText_optional=code_block_2.out1, Inputs=list_create, Toggle=boolean, CancelButtonText_optional=code_block_2.out2, LabelWidth_optional=code_block_2.out0)  # package Data-Shapes; Create a form with multiple inputs. see www.data-shapes.net for tutorials and infos!
nullItem = WombatDynamo.List.NullItem()
if_ = If(test=multipleinputform.Was_Cancelled, true=nullItem, false=multipleinputform.User_Inputs)
code_block_14 = CodeBlock(l=if_) { l[2]; }
familyType = Custom[FamilyInstance.FamilyType](familyInstance=code_block_14)  # package archi-lab.net; This node will return a Family Type of a given Family Instance. If no Family Type can be assigned to a Family then it will return Null.
family = FamilyType.Family(familyType=familyType)
name_2 = Family.Name(family=family)
code_block_15 = CodeBlock { "EST_D_VIGA_BARRA HORIZONTAL_INFERIOR_PATA IZQUIERDA"; }
eq = name_2 == code_block_15
code_block_16 = CodeBlock { null; }
if_2 = If(test=eq, true=code_block_14, false=code_block_16)
familyinstance_2d_geometry = Custom[FamilyInstance 2D Geometry](element=if_2)  # package Genius Loci; Gets the curves of the family instance. Works only with the family categories : Generic Annotation and Detail Item.
code_block_17 = CodeBlock { 1; }
getItemAtIndex = List.GetItemAtIndex(list=familyinstance_2d_geometry@L2, index=code_block_17)
endPoint = Curve.EndPoint(curve=getItemAtIndex)
code_block_18 = CodeBlock(l=if_) { l[0]; }
current = Document.Current()
activeView = Document.ActiveView(document=current)
byPointInView = Custom[FamilyInstance.ByPointInView](point=endPoint, familyType=code_block_18, view=activeView)  # package Clockwork for Dynamo 2.x; Places a family instance at a given point in a given view (e.g. a detail component).
code_block_19 = CodeBlock { "Cantidad de Barras"; }
code_block_20 = CodeBlock(l=if_) { l[1]; }
setParameterByName = Element.SetParameterByName(element=byPointInView, parameterName=code_block_19, value=code_block_20)
end = Revit.Transaction.Transaction.End(input=setParameterByName)
code_block_21 = CodeBlock { "EST_A_TAG BARRA"; }
byName_3 = Orchid.RevitProject.Elements.Family.ByName(name=code_block_21)
code_block_22 = CodeBlock { "Barra Horizontal Recta"; }
byFamilyAndName = FamilyType.ByFamilyAndName(family=byName_3, name=code_block_22)

# group: BARRA VERTICAL CON PATA INFERIOR
activeView_2 = Orchid.RevitProject.Common.Document.ActiveView()
familyinstance_2d_geometry_2 = Custom[FamilyInstance 2D Geometry](element=end)
code_block_23 = CodeBlock { 0; }
getItemAtIndex_2 = List.GetItemAtIndex(list=familyinstance_2d_geometry_2@L2, index=code_block_23)
code_block_24 = CodeBlock { 0.5; }
pointAtParameter = Curve.PointAtParameter(curve=getItemAtIndex_2, param=code_block_24)
boolean_2 = BoolSelector(true)
create_tag = Custom[Create Tag](view=activeView_2@L1, element=end@L1, TagLocation=pointAtParameter@L1, TagType=byFamilyAndName@L1, RunIt=boolean_2@L1)  # package Genius Loci; Works only in Revit 2018 and later. Creates a tag at a given location, of given type and in a supplied view. The node also works with Linked Elements (except space and area), Multi Category tag and Material Tag. Based on an archilab node
tag_getlocation = Custom[Tag GetLocation](tag=create_tag@L1)  # package Genius Loci; Retrieves the position of the head of tag.
code_block_25 = CodeBlock { -200; }
translate = Geometry.Translate(geometry=tag_getlocation, zTranslation=code_block_25)
tag_setlocation = Custom[Tag SetLocation](tag=create_tag@L1, location=translate@L1)  # package Genius Loci; Moves the head of the tag to the given location point.

activeView_3 = Orchid.RevitProject.Common.Document.ActiveView()

# group: EMPALMES
familyinstance_2d_geometry_3 = Custom[FamilyInstance 2D Geometry](element=end)
code_block_26 = CodeBlock { 2; }
getItemAtIndex_3 = List.GetItemAtIndex(list=familyinstance_2d_geometry_3@L2, index=code_block_26)
familyinstance_references = Custom[FamilyInstance References](familyInstance=end)  # package Genius Loci; Returns all references and references names.
code_block_27 = CodeBlock { "Empalme"; }
contains = Orchid.Common.String.Contains(string=familyinstance_references.ReferenceName, searchFor=code_block_27)
filterByBoolMask = List.FilterByBoolMask(list=familyinstance_references.Reference, mask=contains)
converted_from_dropdown_with = CodeBlock { DSCore.Types.FindTypeByNameInAssembly("DimensionType", "RevitAPI"); }  # "Converted from Dropdown with Monocle™"
all_elements_of_type = ElementsOfType(element_type=converted_from_dropdown_with)
name_3 = Element.Name(element=all_elements_of_type)
code_block_28 = CodeBlock { "EST_EMPALME"; }
eq_2 = name_3 == code_block_28
filterByBoolMask_2 = List.FilterByBoolMask(list=all_elements_of_type, mask=eq_2)
dimension_byreferences = Custom[Dimension ByReferences](view=activeView_3, line=getItemAtIndex_3, references=filterByBoolMask.in, dimensionType=filterByBoolMask_2.in, lacing=Longest)  # package Genius Loci; Creates a new linear dimension from at least two geometric references of an object.
ʳʰʸᵗʰᵐ_dimensions_getcurve = Rhythm.Revit.Elements.Dimensions.GetCurve(dimension=dimension_byreferences)
code_block_29 = CodeBlock { 0.5; }
pointAtParameter_2 = Curve.PointAtParameter(curve=ʳʰʸᵗʰᵐ_dimensions_getcurve, param=code_block_29)
code_block_30 = CodeBlock { -600; }
translate_2 = Geometry.Translate(geometry=pointAtParameter_2, zTranslation=code_block_30)
element_setlocation = Custom[Element SetLocation](element=dimension_byreferences, location=translate_2)  # package Genius Loci; Modify the location of the given element. (Same as the Move command in Revit.) Works for point/ line/ sketch based elements, view-specific elements, groups and link instances.

code_block_31 = CodeBlock { "EST_D_VIGA_BARRA HORIZONTAL_INFERIOR_RECTA"; }
eq_3 = name_2 == code_block_31
code_block_32 = CodeBlock { null; }
if_3 = If(test=eq_3, true=code_block_14, false=code_block_32)
familyinstance_2d_geometry_4 = Custom[FamilyInstance 2D Geometry](element=if_3)
code_block_33 = CodeBlock { 0; }
getItemAtIndex_4 = List.GetItemAtIndex(list=familyinstance_2d_geometry_4@L2, index=code_block_33)
startPoint = Curve.StartPoint(curve=getItemAtIndex_4)
current_2 = Document.Current()
activeView_4 = Document.ActiveView(document=current_2)
byPointInView_2 = Custom[FamilyInstance.ByPointInView](point=startPoint, familyType=code_block_18, view=activeView_4)
code_block_34 = CodeBlock { "Cantidad de Barras"; }
setParameterByName_2 = Element.SetParameterByName(element=byPointInView_2, parameterName=code_block_34, value=code_block_20)
end_2 = Revit.Transaction.Transaction.End(input=setParameterByName_2)
code_block_35 = CodeBlock { "EST_A_TAG BARRA"; }
byName_4 = Orchid.RevitProject.Elements.Family.ByName(name=code_block_35)
code_block_36 = CodeBlock { "Barra Horizontal Recta"; }
byFamilyAndName_2 = FamilyType.ByFamilyAndName(family=byName_4, name=code_block_36)

# group: BARRA VERTICAL CON PATA INFERIOR
activeView_5 = Orchid.RevitProject.Common.Document.ActiveView()
familyinstance_2d_geometry_5 = Custom[FamilyInstance 2D Geometry](element=end_2)
code_block_37 = CodeBlock { 0; }
getItemAtIndex_5 = List.GetItemAtIndex(list=familyinstance_2d_geometry_5@L2, index=code_block_37)
code_block_38 = CodeBlock { 0.5; }
pointAtParameter_3 = Curve.PointAtParameter(curve=getItemAtIndex_5, param=code_block_38)
boolean_3 = BoolSelector(true)
create_tag_2 = Custom[Create Tag](view=activeView_5@L2, element=end_2@L1, TagLocation=pointAtParameter_3@L1, TagType=byFamilyAndName_2@L1, RunIt=boolean_3@L1)
tag_getlocation_2 = Custom[Tag GetLocation](tag=create_tag_2)
code_block_39 = CodeBlock { -200; }
translate_3 = Geometry.Translate(geometry=tag_getlocation_2, zTranslation=code_block_39)
tag_setlocation_2 = Custom[Tag SetLocation](tag=create_tag_2, location=translate_3)

activeView_6 = Orchid.RevitProject.Common.Document.ActiveView()

# group: EMPALMES
familyinstance_2d_geometry_6 = Custom[FamilyInstance 2D Geometry](element=end_2)
code_block_40 = CodeBlock { 2; }
getItemAtIndex_6 = List.GetItemAtIndex(list=familyinstance_2d_geometry_6@L2, index=code_block_40)
familyinstance_references_2 = Custom[FamilyInstance References](familyInstance=end_2)
code_block_41 = CodeBlock { "Empalme"; }
contains_2 = Orchid.Common.String.Contains(string=familyinstance_references_2.ReferenceName, searchFor=code_block_41)
filterByBoolMask_3 = List.FilterByBoolMask(list=familyinstance_references_2.Reference, mask=contains_2)
converted_from_dropdown_with_2 = CodeBlock { DSCore.Types.FindTypeByNameInAssembly("DimensionType", "RevitAPI"); }  # "Converted from Dropdown with Monocle™"
all_elements_of_type_2 = ElementsOfType(element_type=converted_from_dropdown_with_2)
name_4 = Element.Name(element=all_elements_of_type_2)
code_block_42 = CodeBlock { "EST_EMPALME"; }
eq_4 = name_4 == code_block_42
filterByBoolMask_4 = List.FilterByBoolMask(list=all_elements_of_type_2, mask=eq_4)
dimension_byreferences_2 = Custom[Dimension ByReferences](view=activeView_6, line=getItemAtIndex_6, references=filterByBoolMask_3.in, dimensionType=filterByBoolMask_4.in, lacing=Longest)
ʳʰʸᵗʰᵐ_dimensions_getcurve_2 = Rhythm.Revit.Elements.Dimensions.GetCurve(dimension=dimension_byreferences_2)
code_block_43 = CodeBlock { 0.5; }
pointAtParameter_4 = Curve.PointAtParameter(curve=ʳʰʸᵗʰᵐ_dimensions_getcurve_2, param=code_block_43)
code_block_44 = CodeBlock { -600; }
translate_4 = Geometry.Translate(geometry=pointAtParameter_4, zTranslation=code_block_44)
element_setlocation_2 = Custom[Element SetLocation](element=dimension_byreferences_2, location=translate_4)

o_document_activeview = Orchid.RevitProject.Common.Document.ActiveView()
code_block_45 = CodeBlock { "EST_D_VIGA_BARRA HORIZONTAL_INFERIOR_EMPOTRADA_PATA IZQUIERDA"; }
eq_5 = name_2 == code_block_45
code_block_46 = CodeBlock { null; }
if_4 = If(test=eq_5, true=code_block_14, false=code_block_46)
familyinstance_2d_geometry_7 = Custom[FamilyInstance 2D Geometry](element=if_4)
code_block_47 = CodeBlock { 2; }
getItemAtIndex_7 = List.GetItemAtIndex(list=familyinstance_2d_geometry_7@L2, index=code_block_47)
endPoint_2 = Curve.EndPoint(curve=getItemAtIndex_7)
current_3 = Document.Current()
activeView_7 = Document.ActiveView(document=current_3)
byPointInView_3 = Custom[FamilyInstance.ByPointInView](point=endPoint_2, familyType=code_block_18, view=activeView_7)
code_block_48 = CodeBlock { "Cantidad de Barras"; }
setParameterByName_3 = Element.SetParameterByName(element=byPointInView_3, parameterName=code_block_48, value=code_block_20)
end_3 = Revit.Transaction.Transaction.End(input=setParameterByName_3)

# group: EMPALMES
familyinstance_2d_geometry_8 = Custom[FamilyInstance 2D Geometry](element=end_3)
code_block_49 = CodeBlock { 2; }
getItemAtIndex_8 = List.GetItemAtIndex(list=familyinstance_2d_geometry_8@L2, index=code_block_49)
familyinstance_references_3 = Custom[FamilyInstance References](familyInstance=end_3)
code_block_50 = CodeBlock { "Empalme"; }
o_string_contains = Orchid.Common.String.Contains(string=familyinstance_references_3.ReferenceName, searchFor=code_block_50)
filterByBoolMask_5 = List.FilterByBoolMask(list=familyinstance_references_3.Reference, mask=o_string_contains)
converted_from_dropdown_with_3 = CodeBlock { DSCore.Types.FindTypeByNameInAssembly("DimensionType", "RevitAPI"); }  # "Converted from Dropdown with Monocle™"
all_elements_of_type_3 = ElementsOfType(element_type=converted_from_dropdown_with_3)
name_5 = Element.Name(element=all_elements_of_type_3)
code_block_51 = CodeBlock { "EST_EMPALME"; }
eq_6 = name_5 == code_block_51
filterByBoolMask_6 = List.FilterByBoolMask(list=all_elements_of_type_3, mask=eq_6)
dimension_byreferences_3 = Custom[Dimension ByReferences](view=o_document_activeview, line=getItemAtIndex_8, references=filterByBoolMask_5.in, dimensionType=filterByBoolMask_6.in, lacing=Longest)
ʳʰʸᵗʰᵐ_dimensions_getcurve_3 = Rhythm.Revit.Elements.Dimensions.GetCurve(dimension=dimension_byreferences_3)
code_block_52 = CodeBlock { 0.5; }
pointAtParameter_5 = Curve.PointAtParameter(curve=ʳʰʸᵗʰᵐ_dimensions_getcurve_3, param=code_block_52)
code_block_53 = CodeBlock { -600; }
translate_5 = Geometry.Translate(geometry=pointAtParameter_5, zTranslation=code_block_53)
element_setlocation_3 = Custom[Element SetLocation](element=dimension_byreferences_3, location=translate_5)

code_block_54 = CodeBlock { "EST_A_TAG BARRA"; }
o_family_byname = Orchid.RevitProject.Elements.Family.ByName(name=code_block_54)
code_block_55 = CodeBlock { "Barra Horizontal Recta"; }
byFamilyAndName_3 = FamilyType.ByFamilyAndName(family=o_family_byname, name=code_block_55)

# group: BARRA VERTICAL CON PATA INFERIOR
o_document_activeview_2 = Orchid.RevitProject.Common.Document.ActiveView()
familyinstance_2d_geometry_9 = Custom[FamilyInstance 2D Geometry](element=end_3)
code_block_56 = CodeBlock { 0; }
getItemAtIndex_9 = List.GetItemAtIndex(list=familyinstance_2d_geometry_9@L2, index=code_block_56)
code_block_57 = CodeBlock { 0.5; }
pointAtParameter_6 = Curve.PointAtParameter(curve=getItemAtIndex_9, param=code_block_57)
boolean_4 = BoolSelector(true)
create_tag_3 = Custom[Create Tag](view=o_document_activeview_2@L1, element=end_3@L1, TagLocation=pointAtParameter_6@L1, TagType=byFamilyAndName_3@L1, RunIt=boolean_4@L1)
tag_getlocation_3 = Custom[Tag GetLocation](tag=create_tag_3@L1)
code_block_58 = CodeBlock { -200; }
translate_6 = Geometry.Translate(geometry=tag_getlocation_3, zTranslation=code_block_58)
tag_setlocation_3 = Custom[Tag SetLocation](tag=create_tag_3@L1, location=translate_6@L1)
