# Dynamo graph script.dyn (Dynamo 2.12.1.8246)
# packages: Clockwork for Dynamo 2.x 2.3.0, Data-Shapes 2021.2.93, MEPover 2020.6.2, Orchid 204.1.4.7501, Genius Loci 2021.4.13, WombatDynamo 2.3.4, Rhythm 2021.4.2, archi-lab.net 2021.25.2621, Orchid 212.1.0.8161

code_block = CodeBlock { "Suple Superior Pata Derecha"; }
file_path = Filename("..\00_IMAGENES\editable Arainco-cmyk-01.png")
code_block_2 = CodeBlock { 160; "INICIAR"; "CANCELAR"; }
code_block_3 = CodeBlock { "Diametro de Barras"; }
code_block_4 = CodeBlock { "EST_D_VIGA_BARRA HORIZONTAL_SUPERIOR_SUPLE_PATA DERECHA"; }
byName = Family.ByName(name=code_block_4)
family_types_of_family = Custom[Family types of family](family=byName)  # package MEPover; Returns every family type of the given Family
sortNatural = Orchid.Common.List.SortNatural(list=family_types_of_family)
name = Element.Name(element=sortNatural)
code_block_5 = CodeBlock { 4; }
code_block_6 = CodeBlock { false; }
dropdown_data = Custom[DropDown Data](InputName=code_block_3, Keys=name, Values=sortNatural, DefaultValueIndex=code_block_5, Sorted_optional=code_block_6)  # package Data-Shapes; Create data for DropDown input in UI.MultiInputForm ++ . Check out www.data-shapes.net for more infos.
code_block_7 = CodeBlock { "Cantidad de Barras"; }
code_block_8 = CodeBlock { 1..10..1; 1; }
code_block_9 = CodeBlock { false; }
dropdown_data_2 = Custom[DropDown Data](InputName=code_block_7, Keys=code_block_8.out0, Values=code_block_8.out0, DefaultValueIndex=code_block_8.out1, Sorted_optional=code_block_9)
code_block_10 = CodeBlock { "Selecciona una Barra de Primera Capa"; }
code_block_11 = CodeBlock { "SELECCIONAR"; }
code_block_12 = CodeBlock { "Detail Items"; }
byName_2 = Category.ByName(name=code_block_12)
code_block_13 = CodeBlock { true; }
selectmodelelements_data = Custom[SelectModelElements Data](InputName=code_block_10, ButtonText=code_block_11, CategoryFilter=byName_2, SelectSingleElement=code_block_13)  # package Data-Shapes; Creates a Revit element selection input for UI.MultipleInputForm++ . Check out www.data-shapes.net for more infos!
list_create = List.Create(item0=dropdown_data, item1=dropdown_data_2, item2=selectmodelelements_data)
boolean = BoolSelector(true)
multipleinputform = Custom[MultipleInputForm ++](Description_optional=code_block, Logo_optional=file_path, ButtonText_optional=code_block_2.out1, Inputs=list_create, Toggle=boolean, CancelButtonText_optional=code_block_2.out2, LabelWidth_optional=code_block_2.out0)  # package Data-Shapes; Create a form with multiple inputs. see www.data-shapes.net for tutorials and infos!
nullItem = WombatDynamo.List.NullItem()
if_ = If(test=multipleinputform.Was_Cancelled, true=nullItem, false=multipleinputform.User_Inputs)
code_block_14 = CodeBlock(l=if_) { l[2]; }
familyType = Custom[FamilyInstance.FamilyType](familyInstance=code_block_14)  # package archi-lab.net; This node will return a Family Type of a given Family Instance. If no Family Type can be assigned to a Family then it will return Null.
family = FamilyType.Family(familyType=familyType)
name_2 = Family.Name(family=family)
code_block_15 = CodeBlock { "EST_D_VIGA_BARRA HORIZONTAL_SUPERIOR_DOS PATAS"; }
eq = name_2 == code_block_15
code_block_16 = CodeBlock { null; }
if_2 = If(test=eq, true=code_block_14, false=code_block_16)
familyinstance_2d_geometry = Custom[FamilyInstance 2D Geometry](element=if_2)  # package Genius Loci; Gets the curves of the family instance. Works only with the family categories : Generic Annotation and Detail Item.
code_block_17 = CodeBlock { 1; }
getItemAtIndex = List.GetItemAtIndex(list=familyinstance_2d_geometry@L2, index=code_block_17)
endPoint = Curve.EndPoint(curve=getItemAtIndex)
code_block_18 = CodeBlock(l=if_) { l[0]; }
o_document_activeview = Orchid.RevitProject.Common.Document.ActiveView()
byPointInView = Custom[FamilyInstance.ByPointInView](point=endPoint, familyType=code_block_18, view=o_document_activeview)  # package Clockwork for Dynamo 2.x; Places a family instance at a given point in a given view (e.g. a detail component).
code_block_19 = CodeBlock { "Cantidad de Barras"; }
code_block_20 = CodeBlock(l=if_) { l[1]; }
setParameterByName = Element.SetParameterByName(element=byPointInView, parameterName=code_block_19, value=code_block_20)
end = Revit.Transaction.Transaction.End(input=setParameterByName)
code_block_21 = CodeBlock { "Detail Item Tags"; }
byName_3 = Category.ByName(name=code_block_21)
all_family_types_of_category = Custom[All Family Types Of Category](category=byName_3)  # package Clockwork for Dynamo 2.x; Gets all family types/symbols of a given category in the model.
familyName = Custom[FamilyType.FamilyName](familyType=all_family_types_of_category)  # package Clockwork for Dynamo 2.x; Returns the *family* name of a given family *type*
string = StringInput("EST_A_VIGA_SUPLE SUPERIOR_TAG BARRA")
eq_2 = familyName == string  # lacing=Longest
filterByBoolMask = List.FilterByBoolMask(list=all_family_types_of_category, mask=eq_2)
code_block_22 = CodeBlock(l=filterByBoolMask.in) { l[2]; }

# group: BARRA VERTICAL CON PATA INFERIOR
activeView = Orchid.RevitProject.Common.Document.ActiveView()
familyinstance_2d_geometry_2 = Custom[FamilyInstance 2D Geometry](element=end)
code_block_23 = CodeBlock { 1; }
getItemAtIndex_2 = List.GetItemAtIndex(list=familyinstance_2d_geometry_2@L2, index=code_block_23)
code_block_24 = CodeBlock { 0.5; }
pointAtParameter = Curve.PointAtParameter(curve=getItemAtIndex_2, param=code_block_24)
boolean_2 = BoolSelector(true)
create_tag = Custom[Create Tag](view=activeView, element=end, TagLocation=pointAtParameter, TagType=code_block_22, RunIt=boolean_2)  # package Genius Loci; Works only in Revit 2018 and later. Creates a tag at a given location, of given type and in a supplied view. The node also works with Linked Elements (except space and area), Multi Category tag and Material Tag. Based on an archilab node
tag_getlocation = Custom[Tag GetLocation](tag=create_tag)  # package Genius Loci; Retrieves the position of the head of tag.
code_block_25 = CodeBlock { 550; 100; }
translate = Geometry.Translate(geometry=tag_getlocation, xTranslation=code_block_25.out1, yTranslation=code_block_25.out1, zTranslation=code_block_25.out0)
tag_setlocation = Custom[Tag SetLocation](tag=create_tag, location=translate)  # package Genius Loci; Moves the head of the tag to the given location point.

code_block_26 = CodeBlock { "Leader Line"; 1; }
setParameterByName_2 = Element.SetParameterByName(element=tag_setlocation, parameterName=code_block_26.out0, value=code_block_26.out1)
code_block_27 = CodeBlock { "Leader Type"; 1; }
setParameterByName_3 = Element.SetParameterByName(element=setParameterByName_2, parameterName=code_block_27.out0, value=code_block_27.out1)
translate_2 = Geometry.Translate(geometry=pointAtParameter, zTranslation=code_block_25.out0)
ʳʰʸᵗʰᵐ_tags = Rhythm.Revit.Elements.Tags.SetLeaderElbowPosition(tag=setParameterByName_3, location=translate_2)
ʳʰʸᵗʰᵐ_tags_setleaderendposition = Rhythm.Revit.Elements.Tags.SetLeaderEndPosition(tag=setParameterByName_3, location=pointAtParameter)
code_block_28 = CodeBlock { "EST_D_VIGA_BARRA HORIZONTAL_SUPERIOR_PATA DERECHA"; }
eq_3 = name_2 == code_block_28
code_block_29 = CodeBlock { null; }
if_3 = If(test=eq_3, true=code_block_14, false=code_block_29)
familyinstance_2d_geometry_3 = Custom[FamilyInstance 2D Geometry](element=if_3)
code_block_30 = CodeBlock { 0; }
getItemAtIndex_3 = List.GetItemAtIndex(list=familyinstance_2d_geometry_3@L2, index=code_block_30)
endPoint_2 = Curve.EndPoint(curve=getItemAtIndex_3)
o_document_activeview_2 = Orchid.RevitProject.Common.Document.ActiveView()
byPointInView_2 = Custom[FamilyInstance.ByPointInView](point=endPoint_2, familyType=code_block_18, view=o_document_activeview_2)
code_block_31 = CodeBlock { "Cantidad de Barras"; }
setParameterByName_4 = Element.SetParameterByName(element=byPointInView_2, parameterName=code_block_31, value=code_block_20)
end_2 = Revit.Transaction.Transaction.End(input=setParameterByName_4)
code_block_32 = CodeBlock { "Detail Item Tags"; }
byName_4 = Category.ByName(name=code_block_32)
all_family_types_of_category_2 = Custom[All Family Types Of Category](category=byName_4)
familyName_2 = Custom[FamilyType.FamilyName](familyType=all_family_types_of_category_2)
string_2 = StringInput("EST_A_VIGA_SUPLE SUPERIOR_TAG BARRA")
eq_4 = familyName_2 == string_2  # lacing=Longest
filterByBoolMask_2 = List.FilterByBoolMask(list=all_family_types_of_category_2, mask=eq_4)
code_block_33 = CodeBlock(l=filterByBoolMask_2.in) { l[2]; }

# group: BARRA VERTICAL CON PATA INFERIOR
activeView_2 = Orchid.RevitProject.Common.Document.ActiveView()
familyinstance_2d_geometry_4 = Custom[FamilyInstance 2D Geometry](element=end_2)
code_block_34 = CodeBlock { 1; }
getItemAtIndex_4 = List.GetItemAtIndex(list=familyinstance_2d_geometry_4@L2, index=code_block_34)
code_block_35 = CodeBlock { 0.5; }
pointAtParameter_2 = Curve.PointAtParameter(curve=getItemAtIndex_4, param=code_block_35)
boolean_3 = BoolSelector(true)
create_tag_2 = Custom[Create Tag](view=activeView_2, element=end_2, TagLocation=pointAtParameter_2, TagType=code_block_33, RunIt=boolean_3)
tag_getlocation_2 = Custom[Tag GetLocation](tag=create_tag_2)
code_block_36 = CodeBlock { 550; 100; }
translate_3 = Geometry.Translate(geometry=tag_getlocation_2, xTranslation=code_block_36.out1, yTranslation=code_block_36.out1, zTranslation=code_block_36.out0)
tag_setlocation_2 = Custom[Tag SetLocation](tag=create_tag_2, location=translate_3)

code_block_37 = CodeBlock { "Leader Line"; 1; }
setParameterByName_5 = Element.SetParameterByName(element=tag_setlocation_2, parameterName=code_block_37.out0, value=code_block_37.out1)
code_block_38 = CodeBlock { "Leader Type"; 1; }
setParameterByName_6 = Element.SetParameterByName(element=setParameterByName_5, parameterName=code_block_38.out0, value=code_block_38.out1)
translate_4 = Geometry.Translate(geometry=pointAtParameter_2, zTranslation=code_block_36.out0)
ʳʰʸᵗʰᵐ_tags_2 = Rhythm.Revit.Elements.Tags.SetLeaderElbowPosition(tag=setParameterByName_6, location=translate_4)
ʳʰʸᵗʰᵐ_tags_setleaderendposition_2 = Rhythm.Revit.Elements.Tags.SetLeaderEndPosition(tag=setParameterByName_6, location=pointAtParameter_2)
code_block_39 = CodeBlock { "EST_D_VIGA_BARRA HORIZONTAL_SUPERIOR_EMPOTRADA_PATA DERECHA"; }
eq_5 = name_2 == code_block_39
code_block_40 = CodeBlock { null; }
if_4 = If(test=eq_5, true=code_block_14, false=code_block_40)
familyinstance_2d_geometry_5 = Custom[FamilyInstance 2D Geometry](element=if_4)
code_block_41 = CodeBlock { 0; }
getItemAtIndex_5 = List.GetItemAtIndex(list=familyinstance_2d_geometry_5@L2, index=code_block_41)
endPoint_3 = Curve.EndPoint(curve=getItemAtIndex_5)
o_document_activeview_3 = Orchid.RevitProject.Common.Document.ActiveView()
byPointInView_3 = Custom[FamilyInstance.ByPointInView](point=endPoint_3, familyType=code_block_18, view=o_document_activeview_3)
code_block_42 = CodeBlock { "Cantidad de Barras"; }
setParameterByName_7 = Element.SetParameterByName(element=byPointInView_3, parameterName=code_block_42, value=code_block_20)
end_3 = Revit.Transaction.Transaction.End(input=setParameterByName_7)
code_block_43 = CodeBlock { "Detail Item Tags"; }
byName_5 = Category.ByName(name=code_block_43)
all_family_types_of_category_3 = Custom[All Family Types Of Category](category=byName_5)
familyName_3 = Custom[FamilyType.FamilyName](familyType=all_family_types_of_category_3)
string_3 = StringInput("EST_A_VIGA_SUPLE SUPERIOR_TAG BARRA")
eq_6 = familyName_3 == string_3  # lacing=Longest
filterByBoolMask_3 = List.FilterByBoolMask(list=all_family_types_of_category_3, mask=eq_6)
code_block_44 = CodeBlock(l=filterByBoolMask_3.in) { l[2]; }

# group: BARRA VERTICAL CON PATA INFERIOR
activeView_3 = Orchid.RevitProject.Common.Document.ActiveView()
familyinstance_2d_geometry_6 = Custom[FamilyInstance 2D Geometry](element=end_3)
code_block_45 = CodeBlock { 1; }
getItemAtIndex_6 = List.GetItemAtIndex(list=familyinstance_2d_geometry_6@L2, index=code_block_45)
code_block_46 = CodeBlock { 0.5; }
pointAtParameter_3 = Curve.PointAtParameter(curve=getItemAtIndex_6, param=code_block_46)
boolean_4 = BoolSelector(true)
create_tag_3 = Custom[Create Tag](view=activeView_3, element=end_3, TagLocation=pointAtParameter_3, TagType=code_block_44, RunIt=boolean_4)
tag_getlocation_3 = Custom[Tag GetLocation](tag=create_tag_3)
code_block_47 = CodeBlock { 550; 100; }
translate_5 = Geometry.Translate(geometry=tag_getlocation_3, xTranslation=code_block_47.out1, yTranslation=code_block_47.out1, zTranslation=code_block_47.out0)
tag_setlocation_3 = Custom[Tag SetLocation](tag=create_tag_3, location=translate_5)

code_block_48 = CodeBlock { "Leader Line"; 1; }
setParameterByName_8 = Element.SetParameterByName(element=tag_setlocation_3, parameterName=code_block_48.out0, value=code_block_48.out1)
code_block_49 = CodeBlock { "Leader Type"; 1; }
setParameterByName_9 = Element.SetParameterByName(element=setParameterByName_8, parameterName=code_block_49.out0, value=code_block_49.out1)
translate_6 = Geometry.Translate(geometry=pointAtParameter_3, zTranslation=code_block_47.out0)
ʳʰʸᵗʰᵐ_tags_3 = Rhythm.Revit.Elements.Tags.SetLeaderElbowPosition(tag=setParameterByName_9, location=translate_6)
ʳʰʸᵗʰᵐ_tags_setleaderendposition_3 = Rhythm.Revit.Elements.Tags.SetLeaderEndPosition(tag=setParameterByName_9, location=pointAtParameter_3)
