# Dynamo graph script.dyn (Dynamo 2.12.1.8246)
# packages: Clockwork for Dynamo 2.x 2.3.0, Data-Shapes 2021.2.93, MEPover 2020.6.2, Orchid 204.1.4.7501, Genius Loci 2021.4.13, WombatDynamo 2.3.4, Rhythm 2021.4.2, Orchid 212.1.0.8161

activeView = Orchid.RevitProject.Common.Document.ActiveView()
code_block = CodeBlock { "Suple Superior Barra Recta"; }
file_path = Filename("..\00_IMAGENES\editable Arainco-cmyk-01.png")
code_block_2 = CodeBlock { 150; "INICIAR"; "CANCELAR"; }
code_block_3 = CodeBlock { "Diametro de Barras"; }
code_block_4 = CodeBlock { "EST_D_VIGA_BARRA HORIZONTAL_SUPERIOR_SUPLE_RECTA"; }
byName = Family.ByName(name=code_block_4)
family_types_of_family = Custom[Family types of family](family=byName)  # package MEPover; Returns every family type of the given Family
sortNatural = Orchid.Common.List.SortNatural(list=family_types_of_family)
name = Element.Name(element=sortNatural)
code_block_5 = CodeBlock { 4; }
code_block_6 = CodeBlock { false; }
dropdown_data = Custom[DropDown Data](InputName=code_block_3, Keys=name, Values=sortNatural, DefaultValueIndex=code_block_5, Sorted_optional=code_block_6)  # package Data-Shapes; Create data for DropDown input in UI.MultiInputForm ++ . Check out www.data-shapes.net for more infos.
code_block_7 = CodeBlock { "Cantidad de Barras"; }
code_block_8 = CodeBlock { 1..10..1; 1; }
code_block_9 = CodeBlock { false; }
dropdown_data_2 = Custom[DropDown Data](InputName=code_block_7, Keys=code_block_8.out0, Values=code_block_8.out0, DefaultValueIndex=code_block_8.out1, Sorted_optional=code_block_9)
code_block_10 = CodeBlock { "Selecciona un punto de Inserción"; "SELECCIONAR"; }
selectpointsonface_data = Custom[SelectPointsOnFace data](InputName=code_block_10.out0, ButtonText=code_block_10.out1)  # package Data-Shapes; Creates a UI.MultipleInputForm++ input that allows point on face selection
list_create = List.Create(item0=dropdown_data, item1=dropdown_data_2, item2=selectpointsonface_data)
boolean = BoolSelector(true)
multipleinputform = Custom[MultipleInputForm ++](Description_optional=code_block, Logo_optional=file_path, ButtonText_optional=code_block_2.out1, Inputs=list_create, Toggle=boolean, CancelButtonText_optional=code_block_2.out2, LabelWidth_optional=code_block_2.out0)  # package Data-Shapes; Create a form with multiple inputs. see www.data-shapes.net for tutorials and infos!
nullItem = WombatDynamo.List.NullItem()
if_ = If(test=multipleinputform.Was_Cancelled, true=nullItem, false=multipleinputform.User_Inputs)
code_block_11 = CodeBlock(l=if_) { l[2]; }
code_block_12 = CodeBlock(l=if_) { l[0]; }
o_document_activeview = Orchid.RevitProject.Common.Document.ActiveView()
byPointInView = Custom[FamilyInstance.ByPointInView](point=code_block_11, familyType=code_block_12, view=o_document_activeview)  # package Clockwork for Dynamo 2.x; Places a family instance at a given point in a given view (e.g. a detail component).
code_block_13 = CodeBlock { "Cantidad de Barras"; }
code_block_14 = CodeBlock(l=if_) { l[1]; }
setParameterByName = Element.SetParameterByName(element=byPointInView, parameterName=code_block_13, value=code_block_14)
end = Revit.Transaction.Transaction.End(input=setParameterByName)
familyinstance_2d_geometry = Custom[FamilyInstance 2D Geometry](element=end)  # package Genius Loci; Gets the curves of the family instance. Works only with the family categories : Generic Annotation and Detail Item.
code_block_15 = CodeBlock { 1; }
getItemAtIndex = List.GetItemAtIndex(list=familyinstance_2d_geometry@L2, index=code_block_15)
code_block_16 = CodeBlock { 0.5; }
pointAtParameter = Curve.PointAtParameter(curve=getItemAtIndex, param=code_block_16)
code_block_17 = CodeBlock { "Detail Item Tags"; }
byName_2 = Category.ByName(name=code_block_17)
all_family_types_of_category = Custom[All Family Types Of Category](category=byName_2)  # package Clockwork for Dynamo 2.x; Gets all family types/symbols of a given category in the model.
familyName = Custom[FamilyType.FamilyName](familyType=all_family_types_of_category)  # package Clockwork for Dynamo 2.x; Returns the *family* name of a given family *type*
string = StringInput("EST_A_VIGA_SUPLE SUPERIOR_TAG BARRA")
eq = familyName == string  # lacing=Longest
filterByBoolMask = List.FilterByBoolMask(list=all_family_types_of_category, mask=eq)
code_block_18 = CodeBlock(l=filterByBoolMask.in) { l[1]; }
boolean_2 = BoolSelector(true)
create_tag = Custom[Create Tag](view=activeView, element=end, TagLocation=pointAtParameter, TagType=code_block_18, RunIt=boolean_2)  # package Genius Loci; Works only in Revit 2018 and later. Creates a tag at a given location, of given type and in a supplied view. The node also works with Linked Elements (except space and area), Multi Category tag and Material Tag. Based on an archilab node
tag_getlocation = Custom[Tag GetLocation](tag=create_tag)  # package Genius Loci; Retrieves the position of the head of tag.
code_block_19 = CodeBlock { 550; 100; }
translate = Geometry.Translate(geometry=tag_getlocation, xTranslation=code_block_19.out1, yTranslation=code_block_19.out1, zTranslation=code_block_19.out0)
tag_setlocation = Custom[Tag SetLocation](tag=create_tag, location=translate)  # package Genius Loci; Moves the head of the tag to the given location point.
code_block_20 = CodeBlock { "Leader Line"; 1; }
setParameterByName_2 = Element.SetParameterByName(element=tag_setlocation, parameterName=code_block_20.out0, value=code_block_20.out1)
code_block_21 = CodeBlock { "Leader Type"; 1; }
setParameterByName_3 = Element.SetParameterByName(element=setParameterByName_2, parameterName=code_block_21.out0, value=code_block_21.out1)
ʳʰʸᵗʰᵐ_tags_setleaderendposition = Rhythm.Revit.Elements.Tags.SetLeaderEndPosition(tag=setParameterByName_3, location=pointAtParameter)
code_block_22 = CodeBlock { 550; }
translate_2 = Geometry.Translate(geometry=tag_getlocation, zTranslation=code_block_22)
ʳʰʸᵗʰᵐ_tags = Rhythm.Revit.Elements.Tags.SetLeaderElbowPosition(tag=setParameterByName_3, location=translate_2)
